# Dynamo graph U9-TrackLine_3.4.04_wForwardPass.dyn (Dynamo 2.10.1.3976)

# group: General Parameters
no_of_levels = IntegerSlider(2, range=2..4 step 1)
no_of_track_lines = IntegerSlider(4, range=2..8 step 1)
no_of_exits = IntegerSlider(2, range=1..4 step 1)
no_of_column_rows = IntegerSlider(2, range=0..2 step 1)  # graph input
column_spacing = DoubleSlider(6, range=2..20 step 0.5)
wall_height = DoubleSlider(8, range=5..50 step 0.1)  # graph input
general_parameter_list = List.Create(item0=no_of_levels, item1=no_of_track_lines, item2=no_of_exits, item3=no_of_column_rows, item4=column_spacing, item5=wall_height)

# group: Vertical Transportation
number_of_stairs = IntegerSlider(1, range=0..1 step 1)
stair_width = DoubleSlider(2.4, range=1.2..6 step 0.6)
escalators_facing_inwards = BoolSelector(true)  # graph input
number_of_escalators = IntegerSlider(2, range=1..3 step 1)
escalator_width_gross = DoubleSlider(1.8, range=1..2 step 0.1)
elevator_position = DoubleSlider(2, range=1..3 step 1)  # graph input
elevator_length_m = DoubleSlider(6, range=6..10 step 0.5)  # graph input
vertical_transportation_list = List.Create(item0=number_of_stairs, item1=stair_width, item2=escalators_facing_inwards, item3=number_of_escalators, item4=escalator_width_gross, item5=elevator_position, item6=elevator_length_m)
minimum_path_width = DoubleSlider(1.8, range=1.8..20 step 0.1)
clearance_values_ril_813_0202 = CodeBlock()
# ---------- clearance_values_ril_813_0202.designscript (6 lines) ----------
escalatorExitClearance=2.5;
stairExitClearance=1.5;
elevatorExitClearance=1.5;
list=[escalatorExitClearance,
stairExitClearance,
elevatorExitClearance];
# ----------------------------------------
addItemToEnd = List.AddItemToEnd(item=minimum_path_width, list=clearance_values_ril_813_0202.list)

# group: Length Calculation
max_train_length = DoubleInput(115)  # graph input
terminus = BoolSelector(false)  # graph input
bumper_length = DoubleInput(10)  # graph input
standard_length = BoolSelector(true)  # graph input
train_frequency_n_h = DoubleSlider(3, range=1..15 step 1)  # graph input
platform_length_calc_script = Python(IN[0]=max_train_length, IN[1]=terminus, IN[2]=bumper_length, IN[3]=standard_length, IN[4]=train_frequency_n_h)  # CPython3
# ---------- platform_length_calc_script.python (42 lines) ----------
# Load the Python Standard and DesignScript Libraries
import sys
import clr
clr.AddReference('ProtoGeometry')
from Autodesk.DesignScript.Geometry import *

# This script takes the langth of the train and converts it to a platform length, according to officlaa guidelines from DB
# It doesn't include cases of locomotive-hauled trains
length = IN[0]
terminus = IN[1]
bumper = IN[2]
standard_length = IN[3]
train_freq = IN[4]
# stanard buffer-legnth is 5 (Maß  für ungenaues halten)
buffer = 5
# Check if the station is a terminus
if terminus == False:
	length = length + buffer
else:
	length = length + buffer + bumper

# This check if the length is within a certain range
if standard_length == True:
	if length >= 60 and length < 90:
		length = 90
	elif length >= 90 and length < 140:
		length = 140
	elif length >= 140 and length < 170:
		length = 170
	elif length >= 170 and length < 210:
		length = 210
	elif length >= 210 and length < 280:
		length = 280
	elif length >= 280 and length < 320:
		length = 320
	elif length >= 320 and length < 370:
		length = 370
	elif length >=370 and length < 405:
		length = 405

# Assign your output to the OUT variable.
OUT = length
# ----------------------------------------

# group: Platform Width Calculation
velocity_km_h = DoubleSlider(100, range=10..230 step 10)  # graph input
list_of_platform_heights_m = CodeBlock { a=0.96; b=0.76; c=0.55; d=0.38; list=[a,b,c,d]; }
index = IntegerSlider(1, range=0..3 step 1)  # graph input
getItemAtIndex = List.GetItemAtIndex(list=list_of_platform_heights_m.list, index=index)
traffic_level_i = DoubleSlider(1, range=1..3 step 1)  # graph input
local_traffic = BoolSelector(true)  # graph input
regional_traffic = BoolSelector(true)  # graph input
track_spacing_m = DoubleSlider(4.2, range=3.5..8 step 0.1)
platform_width_override = BoolSelector(false)
platform_width_m = DoubleSlider(10, range=0..30 step 0.05)
width_calc_script = Python(IN[0]=velocity_km_h, IN[1]=getItemAtIndex, IN[2]=platform_length_calc_script, IN[3]=traffic_level_i, IN[4]=local_traffic, IN[5]=number_of_escalators, IN[6]=number_of_stairs, IN[7]=elevator_length_m, IN[8]=regional_traffic, IN[9]=track_spacing_m, IN[10]=platform_width_override, IN[11]=platform_width_m, IN[12]=escalator_width_gross, IN[13]=stair_width)  # CPython3
# ---------- width_calc_script.python (144 lines) ----------
# Load the Python Standard and DesignScript Libraries
import sys
import clr
clr.AddReference('ProtoGeometry')
from Autodesk.DesignScript.Geometry import *

# Inputs
v = IN[0]
platformHeight = IN[1]
L_b = IN[2]
trafficLevel = IN[3]
localTraffic = IN[4]
numberOfEscalators = IN[5]
numberOfStairs = IN[6]
elevatorLength = IN[7]
regional = IN[8]

stairWidth = IN[13]	#[m]
escalatorWidth = IN[12]
escalatorLength = 25 #[m]

#########################################################################
#########################################################################
#functions
#########################################################################
#########################################################################
def checkDistances(length, width, bs, platformWidth):
	if length < 1:
		dist = 2*bs + 2*0.9
		if dist < 1.6:
			dist = 2
		
		if platformWidth < (width + dist):
			platformWidth = (width + dist)
	if length > 1 and length <= 10:
		dist = 2*bs + 2*1.2
		if dist < 2:
			dist = 2
		
		if platformWidth < (width + dist):
			platformWidth = (width + dist)
	if length > 10:
		dist = 2*bs + 2*1.6
		if dist < 2.4:
			dist = 2.4
		
		if platformWidth < (width + dist):
			platformWidth = (width + dist)
	return platformWidth
#########################################################################
#########################################################################
#Width calculation
#########################################################################
#########################################################################
if IN[10] == False:
	# Calculation "Einbaumaß" aBa, aBi (813.0201A03)
	aBa = 1.7 #backup value
	
	if platformHeight == 0.960:
		aBa = 1.685
	elif platformHeight == 0.760:
		aBa = 1.675
	elif platformHeight == 0.550:
		aBa = 1.670
	elif platformHeight == 0.380:
		aBa = 1.690
	# velocity check "Gefahrenbereich" (813.0201 3(9) )
	if v <= 160:
		bs = 2.5 - aBa
	elif v > 160 & v <= 200:
		bs = 3 - aBa
	else:
		bs = 3.7 - aBa
	#min is the minimum platform width
	platformWidth = 2*bs + 2*0.8
	#check for obstructions (813.0201A04 p. 5-8)
	platformWidth = checkDistances(elevatorLength, elevatorLength, bs, platformWidth)
	platformWidth = checkDistances(escalatorLength, numberOfStairs * stairWidth + numberOfEscalators * escalatorWidth, bs, platformWidth)
	# min width (813.0201A04 2(2) )
	if platformWidth < 3.3:
		platformWidth = 3.3
else:
	platformWidth = IN[11]
	
distTrackPlatform = aBa
if v <= 160:
	dangerZone = 2.5 #[m]	# Gefahrenbereich Lichtraumprofil
else:
	dangerZone = 3.0 
	
distTracks = IN[9]	 #[m]	# Werte nach EBO §10 und Ril 800.0130
outerTrack = dangerZone + distTrackPlatform
innerTracks = 2 * distTrackPlatform + distTracks
safetyStripPlatform = bs
#########################################################################
#########################################################################
#detailed calculation
#########################################################################
#########################################################################
# Caclulation of b_mittel (813.0201A05)
#Q_a = 1
#Q_e = 1
#n_b = 2

#813.0201 A05 p. 2/3
#if trafficLevel == 1:
#	if localTraffic == True:
#		d_v = 0.5
#		d_as = 1.5
#	else:
#		d_v = 0.3
#		d_as = 1
#elif trafficLevel == 2:
#	if localTraffic == True:
#		d_v = 1
#		d_as = 2.5
#	else:
#		d_v = 0.8
#		d_as = 2
#elif trafficLevel == 3:
#	d_v = 1
#	d_as = 2.5
		
# calc A_as
#A_w = Q_e / d_as
#l_access = 1
#w_access = 1
#A_access = l_access * w_access
#l_storage = 2
#w_storage = 2.5 #813.0202 Abs 8 (7)
#A_storage = l_storage * w_storage
#nr_escalators = IN[5] * 2
#w_stairs = nr_escalators * 1.8 # with of escalators
#l_stairs = 1.5 #813.0202, Abs. 5/5 6/5
#A_stairs = l_stairs * w_stairs
#A_service = 10

#A_as = A_w + A_access + A_storage + A_stairs + A_service

#b_mean = (Q_a/(L_b*d_v)) + (Q_e/(L_b*d_as)) + (A_as/L_b) + n_b * bs
#########################################################################
#########################################################################
# Assign your output to the OUT variable.
OUT = platformWidth, platformHeight, trafficLevel, regional, outerTrack, innerTracks, distTracks, distTrackPlatform, dangerZone, safetyStripPlatform
# ----------------------------------------

# group: Top Level Parameters
exit_x_offset_m = DoubleSlider(20, range=5..50 step 0.5)  # graph input
no_of_ticket_machines_per_exit = IntegerSlider(2, range=1..4 step 1)
ticketmachine_x_offset_m = DoubleSlider(7, range=3..15 step 1)  # graph input
top_level_list = List.Create(item0=exit_x_offset_m, item1=no_of_ticket_machines_per_exit, item2=ticketmachine_x_offset_m)

# group: crowd:it Parameters
number_of_agents = DoubleSlider(10, range=5..50 step 5)
tread_width = DoubleSlider(1.1, range=0.8..1.1 step 0.1)
crowdit_list = List.Create(item0=number_of_agents, item1=tread_width)

# group: Family Types
floor_types = FloorTypes("STB 20.0")  # graph input
wall_types = WallTypes("STB 20.0")  # graph input
structural_column_types = StructuralColumnTypes("600 x 750mm")
stair_family_type = FamilyTypes("new_stairs:31/16 Ril 813.0202 5(3)")
escalator_family_type = FamilyTypes("Construction-Escalator_2:FT-01 bis 12 - 30°")
train_family_type = FamilyTypes("IC_Destination_withL:IC_Destination_withL")
train_family_wall_type = FamilyTypes("IC_Walls:IC_Walls")
atm_family_type = FamilyTypes("ATM:ATM")
ticketmachine_family_type = FamilyTypes("Ticketmachine:Ticketmachine")
store_family_type = FamilyTypes("Storebooth:Storebooth")
ticket_validator_family_type = FamilyTypes("Ticket_validator:Standard")
type_activation_script = Python(IN[0]=floor_types, IN[1]=wall_types, IN[2]=structural_column_types, IN[3]=stair_family_type, IN[4]=escalator_family_type, IN[5]=train_family_type, IN[6]=train_family_wall_type, IN[7]=atm_family_type, IN[8]=ticketmachine_family_type, IN[9]=store_family_type, IN[10]=ticket_validator_family_type)  # IronPython2
# ---------- type_activation_script.python (53 lines) ----------
# Load the Python Standard and DesignScript Libraries
import sys
import clr
clr.AddReference('ProtoGeometry')
from Autodesk.DesignScript.Geometry import *

#Import Revit Nodes
clr.AddReference("RevitNodes")
import Revit
clr.ImportExtensions(Revit.Elements)
clr.ImportExtensions(Revit.GeometryConversion)

# Import RevitAPI
clr.AddReference("RevitAPI")
import Autodesk
from Autodesk.Revit.DB import *
from Autodesk.Revit.DB.Architecture import *

# Import DocumentManager and TransactionManager
clr.AddReference("RevitServices")
from RevitServices.Persistence import DocumentManager
from RevitServices.Transactions import TransactionManager
# The inputs to this node will be stored as a list in the IN variables.

# Other type etc. variables
floorType = UnwrapElement(IN[0])
wallType = UnwrapElement(IN[1])
columnType = UnwrapElement(IN[2])
stairType = UnwrapElement(IN[3])
escalatorType = UnwrapElement(IN[4])
trainType = UnwrapElement(IN[5])
trainWallType = UnwrapElement(IN[6])
atmType = UnwrapElement(IN[7])
ticketType = UnwrapElement(IN[8])
storeType = UnwrapElement(IN[9])
validatorType = UnwrapElement(IN[10])

typeList = [floorType, wallType, columnType, stairType, escalatorType, trainType, trainWallType, atmType, ticketType, storeType, validatorType]

doc = DocumentManager.Instance.CurrentDBDocument
#Start Transaction
TransactionManager.Instance.EnsureInTransaction(doc)
		
# Activate the types before create family instance
for type in range(2,len(typeList)):
		if typeList[type].IsActive == False:
			typeList[type].Activate()
			doc.Regenerate
# End Transaction
TransactionManager.Instance.TransactionTaskDone()

# Assign your output to the OUT variable.
OUT = typeList
# ----------------------------------------

# group: out of Order
passengers_train = DoubleSlider(100, range=1..100 step 1)  # graph input

# group: Direct Export
onlyExport = BoolSelector(true)
element_types = ElementTypes("Level")
all_elements_of_type = ElementsOfType(element_type=element_types)
export_floorplans = Python(IN[0]=all_elements_of_type, IN[1]=type_activation_script)  # IronPython2
# ---------- export_floorplans.python (13 lines) ----------
# Load the Python Standard and DesignScript Libraries
import sys
import clr
clr.AddReference('ProtoGeometry')
from Autodesk.DesignScript.Geometry import *

# The inputs to this node will be stored as a list in the IN variables.
dataEnteringNode = IN

# Place your code below this line

# Assign your output to the OUT variable.
OUT = [IN[0], IN[1]]
# ----------------------------------------
if_export_only_eg = BoolSelector(true)

# group: Preparation
levels = Levels("EG")  # graph input
all_elements_at_level = ElementsAtLevel(Level=levels)
delete_all_elements_before_each = BoolSelector(true)  # "Delete All Elements Before Each Run"; graph input
view_to_keep = Views("EG (Architekt)")
base_script = Python(IN[0]=levels, IN[1]=all_elements_at_level, IN[2]=delete_all_elements_before_each, IN[3]=general_parameter_list, IN[4]=vertical_transportation_list, IN[5]=addItemToEnd, IN[6]=width_calc_script, IN[7]=top_level_list, IN[8]=crowdit_list, IN[9]=platform_length_calc_script, IN[10]=type_activation_script, IN[11]=passengers_train, IN[12]=view_to_keep, IN[13]=onlyExport)  # IronPython2
# ---------- base_script.python (229 lines) ----------
# Load the Python Standard and DesignScript Libraries
import clr
import math

from System.Collections.Generic import List

clr.AddReference('ProtoGeometry')
from Autodesk.DesignScript.Geometry import *

#Import Revit Nodes
clr.AddReference("RevitNodes")
import Revit
clr.ImportExtensions(Revit.Elements)
clr.ImportExtensions(Revit.GeometryConversion)

# Import RevitAPI
clr.AddReference("RevitAPI")
import Autodesk
from Autodesk.Revit.DB import *
from Autodesk.Revit.DB.Architecture import *

# Import DocumentManager and TransactionManager
clr.AddReference("RevitServices")
from RevitServices.Persistence import DocumentManager
from RevitServices.Transactions import TransactionManager

# The inputs to this node will be stored as a list in the IN variables.
# Length - Width - height variables

levelEG = UnwrapElement(IN[0])
allElements = UnwrapElement(IN[1])
isDeleteAll = IN[2]

generalParameterList = IN[3]
numberOfLevels = generalParameterList[0]
trackLineCount = generalParameterList[1]
numberofExits = generalParameterList[2]
columnRows = generalParameterList[3]
columnSpacing = generalParameterList[4]
wallHeight = generalParameterList[5]

verticalTransportationList = IN[4]
numberOfStairs = verticalTransportationList[0]
stairWidth = verticalTransportationList[1]
escOrientation = verticalTransportationList[2]
numberOfEscalators = verticalTransportationList[3]
escalatorWidth = verticalTransportationList[4]
elevatorPosition = verticalTransportationList[5]
elevatorLength = verticalTransportationList[6]

clearanceVariablesList = IN[5]

WidthCalcList = IN[6]
platformWidth = WidthCalcList[0]
platformHeight = WidthCalcList[1]
trafficLevel = WidthCalcList[2]
regional = WidthCalcList[3]
outerTrack = WidthCalcList[4]
innerTracks = WidthCalcList[5]
distTracks = WidthCalcList[6]
distTrackPlatform = WidthCalcList[7]
dangerZone = WidthCalcList[8]
safetyStripPlatform = WidthCalcList[9]

topLevelList = IN[7]
exitOffset = topLevelList[0]
numberOfMachines = topLevelList[1]
ticketXOffset = topLevelList[2]

crowditList = IN[8]

length = IN[9]

typeList = IN[10]
floorType = UnwrapElement(typeList[0])
wallType = UnwrapElement(typeList[1])

passengers = IN[11]

# custom:
onlyExport = IN[13]

if not onlyExport:

	doc = DocumentManager.Instance.CurrentDBDocument
	
	# Place your code below this line
	platformCount=int(math.ceil(float(trackLineCount)/2))
	wallThickness= UnitUtils.ConvertFromInternalUnits(wallType.Width, DisplayUnitType.DUT_METERS)
	
	width = platformCount * platformWidth + (platformCount - 1) * (innerTracks) + wallThickness
	if trackLineCount %2 ==0:
		width += 2 * outerTrack
	else:
		width += outerTrack
	
	yAxisList = []
	revitApiYAxisList = []
	for indexY in range(platformCount):
		yAxis = (indexY * platformWidth) + outerTrack + wallThickness/2 + indexY * innerTracks
		yAxisList.append(yAxis)
		revitApiYAxisList.append(UnitUtils.ConvertToInternalUnits(yAxis, DisplayUnitType.DUT_METERS))
	
	escalatorLength = (wallHeight * 1.732050808) + 3.5 + 2.950 +0.4 #Family specific
	
	# Revit Api Unit Type Conversion
	revitApiLength = UnitUtils.ConvertToInternalUnits(length, DisplayUnitType.DUT_METERS)
	revitApiWidth = UnitUtils.ConvertToInternalUnits(width, DisplayUnitType.DUT_METERS)
	revitApiWallHeight = UnitUtils.ConvertToInternalUnits(wallHeight, DisplayUnitType.DUT_METERS)
	revitApiPlatformHeight = UnitUtils.ConvertToInternalUnits(platformHeight, DisplayUnitType.DUT_METERS)
	revitApiPlatformWidth = UnitUtils.ConvertToInternalUnits(platformWidth, DisplayUnitType.DUT_METERS)
	revitApiStairWidth = UnitUtils.ConvertToInternalUnits(stairWidth, DisplayUnitType.DUT_METERS)
	revitApiEscalatorWidth = UnitUtils.ConvertToInternalUnits(escalatorWidth, DisplayUnitType.DUT_METERS)
	revitApiEscalatorLength = UnitUtils.ConvertToInternalUnits(escalatorLength, DisplayUnitType.DUT_METERS)
	revitApiElevatorLength = UnitUtils.ConvertToInternalUnits(elevatorLength, DisplayUnitType.DUT_METERS)
	
	#OUT OF ORDER Stair width calculation
		# set variables dependant on traffic Level
		#if trafficLevel == 1:
		#	v = 1.3 # [m/s]
		#	if regional:
		#		d = 0.5 # [p/m^2]
		#	else: 
		#		d = 0.3
		#elif trafficLevel == 2:
		#	v = 1.3
		#	if regional:
		#		d = 1
		#	else: 
		#		d = 0.8
		#elif trafficLevel == 3:
		#	v = 1.3
		#	d = 1
		#clearanceTime = 150 # [s]
		#stairWidth = passengers/(v * d * clearanceTime) + 0.8 # 813.0202A01 p.1
		# set the width to a standard value 
		#if stairWidth < 0.8:
		#	stairWidth = 0.8
		#elif stairWidth < 1.6:
		#	stairWidth = 1.6
		#elif stairWidth < 2.4:
	
	#Start Transaction
	TransactionManager.Instance.EnsureInTransaction(doc)
	
	# Before Run delete everything for the first time Revit Opened 
	levelArr = FilteredElementCollector(doc).OfCategory(BuiltInCategory.OST_Levels).WhereElementIsNotElementType().ToElements()
	viewArr = FilteredElementCollector(doc).OfCategory(BuiltInCategory.OST_Views).ToElements()
	
	for view in viewArr:
		if view.Name != IN[12].Name and view.ViewType == ViewType.FloorPlan:
			print (view.Title.ToString(), view.Id.ToString(), view.Name.ToString())
			doc.Delete(view.Id)
			
	if levelArr.Count >= 1:
		for levelElem in levelArr:
			if round(levelElem.Elevation,2) == 0.0:
				continue
			doc.Delete(levelElem.Id)
			#doc.Regenerate()
	if isDeleteAll:
		for el in range(len(allElements)-1, -1, -1):
			doc.Delete(allElements[el].Id)
			doc.Regenerate()
	
	# Create Walls based on sizes
	point1 = XYZ(0, 0, 0)
	point2 = XYZ(revitApiLength, 0, 0)
	point3 = XYZ(revitApiLength, revitApiWidth, 0)
	point4 = XYZ(0, revitApiWidth, 0)
	
	# Create 4 Line/Curve for 4 Walls
	line1 = Autodesk.Revit.DB.Line.CreateBound(point1, point2)
	line2 = Autodesk.Revit.DB.Line.CreateBound(point2, point3)
	line3 = Autodesk.Revit.DB.Line.CreateBound(point3, point4)
	line4 = Autodesk.Revit.DB.Line.CreateBound(point4, point1)
	wall1 = Autodesk.Revit.DB.Wall.Create(doc, line1, wallType.Id, levelEG.Id, numberOfLevels * revitApiWallHeight, -revitApiPlatformHeight, False, False)
	wall2 = Autodesk.Revit.DB.Wall.Create(doc, line2, wallType.Id, levelEG.Id, numberOfLevels * revitApiWallHeight, -revitApiPlatformHeight, False, False)
	wall3 = Autodesk.Revit.DB.Wall.Create(doc, line3, wallType.Id, levelEG.Id, numberOfLevels * revitApiWallHeight, -revitApiPlatformHeight, False, False)
	wall4 = Autodesk.Revit.DB.Wall.Create(doc, line4, wallType.Id, levelEG.Id, numberOfLevels * revitApiWallHeight, -revitApiPlatformHeight, False, False)
	wallList = [wall1, wall2, wall3, wall4]
	
	# Base Level Floor creation
	floorList = []
	carray = CurveArray()
	carray.Append(line1)
	carray.Append(line2)
	carray.Append(line3)
	carray.Append(line4)
	floor = doc.Create.NewFloor(carray, floorType, levelEG, False)
	floor.GetParameters("Height Offset From Level")[0].Set(-revitApiPlatformHeight)
	floorList.append(floor)
	
	# Upper Level and their Floor creation based on numberOfLevels arg
	levelList = []
	levelList.append(levelEG)
	if numberOfLevels > 1:
		for levelNumber in range(1, numberOfLevels):
			newLevel = Autodesk.Revit.DB.Level.Create(doc, levelNumber * revitApiWallHeight)
			levelList.append(newLevel)
			lineF1 = Autodesk.Revit.DB.Line.CreateBound(XYZ(point1.X, point1.Y, levelNumber*revitApiWallHeight), XYZ(point2.X, point2.Y, levelNumber*revitApiWallHeight))
			lineF2 = Autodesk.Revit.DB.Line.CreateBound(XYZ(point2.X, point2.Y, levelNumber*revitApiWallHeight), XYZ(point3.X, point3.Y, levelNumber*revitApiWallHeight))
			lineF3 = Autodesk.Revit.DB.Line.CreateBound(XYZ(point3.X, point3.Y, levelNumber*revitApiWallHeight), XYZ(point4.X, point4.Y, levelNumber*revitApiWallHeight))
			lineF4 = Autodesk.Revit.DB.Line.CreateBound(XYZ(point4.X, point4.Y, levelNumber*revitApiWallHeight), XYZ(point1.X, point1.Y, levelNumber*revitApiWallHeight))
			carray = CurveArray()
			carray.Append(lineF1)
			carray.Append(lineF2)
			carray.Append(lineF3)
			carray.Append(lineF4)
			newFloor = doc.Create.NewFloor(carray, floorType, newLevel, False)
			floorList.append(newFloor)
			
		levelNumber += 1
		newLevel = Autodesk.Revit.DB.Level.Create(doc, (levelNumber - 1) * revitApiWallHeight + UnitUtils.ConvertToInternalUnits(4.5, DisplayUnitType.DUT_METERS))
		levelList.append(newLevel)
	
	baseValueList = [length, width, platformHeight, platformWidth, wallHeight, wallThickness, trackLineCount, platformCount, columnRows, columnSpacing, numberOfLevels]
	revitApiBaseList = [revitApiLength, revitApiWidth, revitApiPlatformHeight, revitApiPlatformWidth, revitApiWallHeight, revitApiStairWidth, revitApiEscalatorWidth, revitApiEscalatorLength, revitApiElevatorLength]
	elevationList = [numberOfEscalators, numberOfStairs, escOrientation, elevatorPosition, elevatorLength, escalatorLength, escalatorWidth, stairWidth]
	listList = [levelList, floorList, wallList, yAxisList, revitApiYAxisList, clearanceVariablesList]
	upperLevelList = [exitOffset, ticketXOffset, numberOfMachines, numberofExits]
	trackDataList = [distTracks, distTrackPlatform, outerTrack, innerTracks, dangerZone, safetyStripPlatform]
	#End Transaction
	TransactionManager.Instance.TransactionTaskDone()
	# Assign your output to the OUT variable.
	OUT = [baseValueList, revitApiBaseList, elevationList, listList, upperLevelList, trackDataList, typeList, crowditList]

else:
	OUT = [[], [], [], [], [], [], [], []]
# ----------------------------------------

# group: Geometry Generation
start = Revit.Transaction.Transaction.Start(input=base_script)
main_create_script = Python(IN[0]=start, IN[1]=onlyExport)  # IronPython2
# ---------- main_create_script.python (629 lines) ----------
# Load the Python Standard and DesignScript Libraries
import clr
import math
from math import ceil
clr.AddReference('ProtoGeometry')
from Autodesk.DesignScript.Geometry import *

#Import Revit Nodes
clr.AddReference("RevitNodes")
import Revit
clr.ImportExtensions(Revit.Elements)
clr.ImportExtensions(Revit.GeometryConversion)

# Import RevitAPI
clr.AddReference("RevitAPI")
import Autodesk
from Autodesk.Revit.DB import *
from Autodesk.Revit.DB.Architecture import *

# Import DocumentManager and TransactionManager
clr.AddReference("RevitServices")
from RevitServices.Persistence import DocumentManager
from RevitServices.Transactions import TransactionManager

# Function to rotate a family instance around the z-axis
def ZRotateInstance(angle, instance, point):
	point2 = XYZ(point.X, point.Y, point.Z+10)
	rotationLine = Line.CreateBound(point, point2)
	rotated = instance.Location.Rotate(rotationLine, angle)


# custom:
onlyExport = IN[1]
if not onlyExport:
	# The inputs to this node are stored as a list in the IN variables.
	# Length - Width - height variables
	baseValueList = IN[0][0]
	length= baseValueList[0]
	platformWidth = baseValueList[3]
	wallThickness = baseValueList[5]
	trackLineCount = baseValueList[6]
	platformCount = baseValueList[7]
	columnRows = baseValueList[8]
	columnSpacing = baseValueList[9]
	numberOfLevels = baseValueList[10]
	
	revitApiBaseList = IN[0][1]
	revitApiLength = revitApiBaseList[0]
	revitApiWidth = revitApiBaseList[1]
	revitApiPlatformHeight = revitApiBaseList[2]
	revitApiPlatformWidth = revitApiBaseList[3]
	revitApiWallHeight = revitApiBaseList[4]
	revitApiStairWidth = revitApiBaseList[5]
	revitApiEscalatorWidth = revitApiBaseList[6]
	revitApiEscalatorLength = revitApiBaseList[7]
	revitApiElevatorLength = revitApiBaseList[8]
	
	elevationList = IN[0][2]
	numberOfEscalators = elevationList[0]
	numberOfStairs = elevationList[1]
	escOrientation = elevationList[2]
	elevatorPosition = elevationList[3]
	elevatorLength = elevationList[4]
	escalatorLength = elevationList[5]
	escalatorWidth = elevationList[6]  
	stairWidth = elevationList[7]
	
	listList = IN[0][3]
	levelEG = UnwrapElement(listList[0][0])
	levelList = UnwrapElement(listList[0])
	floorList = UnwrapElement(listList[1])
	wallList = listList[2]
	yAxisList = listList[3]
	revitApiYAxisList = listList[4]
	clearanceVariablesList = listList[5]
	
	upperLevelList = IN[0][4]
	exitXOffset = upperLevelList[0]
	ticketXOffset = upperLevelList[1]
	nrOfMachines = upperLevelList[2]
	numberOfExits = upperLevelList[3]
	
	trackDataList = IN[0][5]
	distTracks = trackDataList[0]
	distTrackPlatform = trackDataList[1]
	innerTracks = trackDataList[3]
	safetyStripWidth = trackDataList[5]
	
	typeList = IN[0][6]
	floorType = UnwrapElement(typeList[0])
	wallType = UnwrapElement(typeList[1])
	columnType = UnwrapElement(typeList[2])
	stairType = UnwrapElement(typeList[3])
	escalatorType = UnwrapElement(typeList[4])
	trainType = UnwrapElement(typeList[5])
	trainWallType = UnwrapElement(typeList[6])
	atmType = UnwrapElement(typeList[7])
	ticketType = UnwrapElement(typeList[8])
	storeType = UnwrapElement(typeList[9])
	validatorType = UnwrapElement(typeList[10])
	
	numberOfAgents = IN[0][7][0]
	treadWidth = IN[0][7][1]
	
	escExitClearance = clearanceVariablesList[0]		#[m] DIN EN 115-1 
	stairExitClearance = clearanceVariablesList[1]		#[m] Ril.813.0202 5(5)
	elevatorExitClearance = clearanceVariablesList[2]	#[m] Ril.813.0202 7(5)
	minPathWidth = clearanceVariablesList[3]			#[m] Ril.813.0202 4(3)
	
	doc = DocumentManager.Instance.CurrentDBDocument
	#Start Transaction
	TransactionManager.Instance.EnsureInTransaction(doc)
	
	# Place your code below this line
	####################################################################################################################################################################################
	####################################################################################################################################################################################
	# Track Lines
	####################################################################################################################################################################################
	####################################################################################################################################################################################
	trainList = []
	trainPartLength = UnitUtils.ConvertFromInternalUnits(trainType.LookupParameter("length").AsDouble(), DisplayUnitType.DUT_METERS)+0.5 #0.5 for Distance between waggons
	rotationAngle = math.pi
	
	#calculate waggon count
	trainPartCount = int(length / trainPartLength)
	trainLength = trainPartCount * trainPartLength
	
	if length - 1 <= trainLength:
		trainPartCount -= 1
		trainLength = trainPartCount * trainPartLength
		
	placementMargin = (length - trainLength) / 2
	
	# Track line Y Axis Coordinates Calculation
	yAxisOfTrackLineCoordinateList = []
	for indexY in range( platformCount):
		yAxis = yAxisList[indexY] - min(indexY,1)*distTracks
		yAxisOfTrackLineCoordinateList.append(yAxis)
		if indexY > 0 :
			secondMiddleTrack = yAxis + distTracks
			yAxisOfTrackLineCoordinateList.append(secondMiddleTrack)
			yAxisWall = secondMiddleTrack - innerTracks/2
			revitApiYAxisWall = UnitUtils.ConvertToInternalUnits(yAxisWall, DisplayUnitType.DUT_METERS)
			revitApiInterWallHeight = UnitUtils.ConvertToInternalUnits(1.5, DisplayUnitType.DUT_METERS)
			point1 = XYZ(0, revitApiYAxisWall, 0)
			point2 = XYZ(revitApiLength, revitApiYAxisWall, 0)
			line1 = Autodesk.Revit.DB.Line.CreateBound(point1, point2)
			Autodesk.Revit.DB.Wall.Create(doc, line1, wallType.Id, levelEG.Id, revitApiInterWallHeight, -revitApiPlatformHeight, False, False)
	if trackLineCount%2 == 0:
		if trackLineCount == 2:
			yAxis =  yAxis + platformWidth + innerTracks - distTracks
			yAxisOfTrackLineCoordinateList.append(yAxis)
		else:
			yAxis =  yAxis + platformWidth + innerTracks
			yAxisOfTrackLineCoordinateList.append(yAxis)
	
	counter = 0
	# Track Line Creation
	for yAxis in yAxisOfTrackLineCoordinateList:	
		trainYAxis = UnitUtils.ConvertToInternalUnits(yAxis, DisplayUnitType.DUT_METERS) 
		
		for index in range(1,trainPartCount+1,1): 
			xAxis = index * trainPartLength - trainPartLength + placementMargin
			revitApiXAxis = UnitUtils.ConvertToInternalUnits(xAxis, DisplayUnitType.DUT_METERS)
			# Train Creation
			trainPoint = XYZ(revitApiXAxis, trainYAxis + UnitUtils.ConvertToInternalUnits(-distTrackPlatform, DisplayUnitType.DUT_METERS), -revitApiPlatformHeight)
			
			train = doc.Create.NewFamilyInstance(trainPoint, trainType, levelEG, Autodesk.Revit.DB.Structure.StructuralType.NonStructural)
			train.LookupParameter("accu_rate_type").Set("Origin")
			train.LookupParameter("Number_Of_Agents").Set(numberOfAgents)
				
			trainWall = doc.Create.NewFamilyInstance(trainPoint, trainWallType, levelEG, Autodesk.Revit.DB.Structure.StructuralType.NonStructural)
			trainWall.LookupParameter("IfcExportAs").Set("IfcWall")
			
			if counter%2 == 0:
				rotationTrainPoint = XYZ(revitApiXAxis + UnitUtils.ConvertToInternalUnits(trainPartLength/2, DisplayUnitType.DUT_METERS), trainYAxis + UnitUtils.ConvertToInternalUnits(-distTrackPlatform, DisplayUnitType.DUT_METERS), 0)
				ZRotateInstance(rotationAngle, train,  rotationTrainPoint)
				ZRotateInstance(rotationAngle, trainWall, rotationTrainPoint)
			wrapTrain = train.ToDSType(False)			
			trainList.append(wrapTrain)
		counter = counter + 1	
	
	####################################################################################################################################################################################
	####################################################################################################################################################################################
	# Platforms
	####################################################################################################################################################################################
	####################################################################################################################################################################################
	for yAxis in revitApiYAxisList:
		point1 = XYZ(0, yAxis, 0)
		point2 = XYZ(revitApiLength, yAxis, 0)
		point3 = XYZ(revitApiLength, yAxis + revitApiPlatformWidth, 0)
		point4 = XYZ(0, yAxis + revitApiPlatformWidth, 0)
		
		line1 = Autodesk.Revit.DB.Line.CreateBound(point1, point2)
		line2 = Autodesk.Revit.DB.Line.CreateBound(point2, point3)
		line3 = Autodesk.Revit.DB.Line.CreateBound(point3, point4)
		line4 = Autodesk.Revit.DB.Line.CreateBound(point4, point1)
		
		carray = CurveArray()
		carray.Append(line1)
		carray.Append(line2)
		carray.Append(line3)
		carray.Append(line4)
		floor = doc.Create.NewFloor(carray, floorType, levelEG, False)
		floor.GetParameters("Height Offset From Level")[0].Set(0)
	####################################################################################################################################################################################
	####################################################################################################################################################################################
	# Elevators and Stairs
	####################################################################################################################################################################################
	####################################################################################################################################################################################
	escalatorList = []
	holeList = []
	#Offset to yAxis
	minDistToEdge = (platformWidth - escalatorWidth * numberOfEscalators - stairWidth * numberOfStairs)/2 #assures centered placement if ElevatorWidth was the decisive size after guidelines
	
	#xAxis Centered
	xAxisCenter = length/2
	
	# Parameters for lower escalator positioning (dependant on elevator position)
	if elevatorPosition == 1: 	#left
		xAxisEscalator =  minPathWidth + escExitClearance + wallThickness/2# +- for both sides; Wallthickness/2 because it referrs to wall axis
		xAxisCenter += elevatorLength
		occupiedXSpaceElevator = (0,elevatorLength + elevatorExitClearance + wallThickness/2)
	elif elevatorPosition == 2:	#middle
		xAxisEscalator = elevatorLength/2 + elevatorExitClearance + minPathWidth + escExitClearance + wallThickness/2 # +- for both sides
		occupiedXSpaceElevator = (xAxisCenter - elevatorLength/2 - elevatorExitClearance - minPathWidth, xAxisCenter + elevatorLength/2 + elevatorExitClearance + minPathWidth)
	elif elevatorPosition == 3:	#right
		xAxisEscalator =  minPathWidth + escExitClearance + wallThickness/2
		xAxisCenter -= elevatorLength	
		occupiedXSpaceElevator = (length - elevatorLength - elevatorExitClearance - wallThickness/2, length)	
	
	# Parameters dependant on escalator orientation (True: Facing Inwards; False: Outwards)
	if escOrientation:
		revitApiOrientationOffsetLeft = 0
		revitApiOrientationOffsetRight = revitApiEscalatorWidth
		rotationAngle = 0
		wallOrientation = 1
	else:
		revitApiOrientationOffsetLeft = revitApiEscalatorWidth
		revitApiOrientationOffsetRight = 0
		rotationAngle = math.pi
		wallOrientation = -1
		xAxisEscalator += escalatorLength 
	
	revitApiEscalatorXStartRight = UnitUtils.ConvertToInternalUnits(xAxisCenter + xAxisEscalator, DisplayUnitType.DUT_METERS)
	revitApiEscalatorXStartLeft  = UnitUtils.ConvertToInternalUnits(xAxisCenter - xAxisEscalator, DisplayUnitType.DUT_METERS)
	
	# Placements
	for yIndex in range(platformCount):
		yAxis = yAxisList[yIndex] # Bottom Edge of the Platform #PlatformyAxis
		escalatorYStart = yAxis+ minDistToEdge 						 
		revitApiEscalatorYStart = UnitUtils.ConvertToInternalUnits(escalatorYStart, DisplayUnitType.DUT_METERS)
		
	# Elevators
		# Start is bottom left point
		if elevatorPosition == 1:
			revitApiElevatorXStart = 0	
		elif elevatorPosition == 2:
			revitApiElevatorXStart = revitApiLength/2 - revitApiElevatorLength/2
		elif elevatorPosition == 3: 
			revitApiElevatorXStart = revitApiLength - revitApiElevatorLength
					
		# place the elevator in the middle of the platform
		revitApiDistanceToPlatformAxis = (revitApiPlatformWidth - revitApiElevatorLength)/2										
		revitApiElevatorYStart = UnitUtils.ConvertToInternalUnits(yAxis, DisplayUnitType.DUT_METERS) + revitApiDistanceToPlatformAxis
				
		# Create Elevator walls 
		point1 = XYZ(revitApiElevatorXStart, revitApiElevatorYStart, 0)
		point2 = XYZ(revitApiElevatorXStart + revitApiElevatorLength, revitApiElevatorYStart, 0)
		point3 = XYZ(revitApiElevatorXStart, revitApiElevatorYStart + revitApiElevatorLength, 0)
		point4 = XYZ(revitApiElevatorXStart + revitApiElevatorLength, revitApiElevatorYStart + revitApiElevatorLength, 0)
		
		line1 = Autodesk.Revit.DB.Line.CreateBound(point1, point2)
		line2 = Autodesk.Revit.DB.Line.CreateBound(point1, point3)
		line3 = Autodesk.Revit.DB.Line.CreateBound(point2, point4)
		line4 = Autodesk.Revit.DB.Line.CreateBound(point3, point4)
		
		wall1 = Autodesk.Revit.DB.Wall.Create(doc, line1, wallType.Id, levelList[0].Id, (revitApiWallHeight*numberOfLevels)-revitApiPlatformHeight, -revitApiPlatformHeight, False, False)
		wall2 = Autodesk.Revit.DB.Wall.Create(doc, line2, wallType.Id, levelList[0].Id, (revitApiWallHeight*numberOfLevels)-revitApiPlatformHeight, -revitApiPlatformHeight, False, False)
		wall3 = Autodesk.Revit.DB.Wall.Create(doc, line3, wallType.Id, levelList[0].Id, (revitApiWallHeight*numberOfLevels)-revitApiPlatformHeight, -revitApiPlatformHeight, False, False)
		wall4 = Autodesk.Revit.DB.Wall.Create(doc, line4, wallType.Id, levelList[0].Id, (revitApiWallHeight*numberOfLevels)-revitApiPlatformHeight, -revitApiPlatformHeight, False, False)
	
		#Opening
		if numberOfLevels > 1:
			carray = CurveArray()
			carray.Append(line1)
			carray.Append(line2)
			carray.Append(line3)
			carray.Append(line4)	
		for level in range(1, numberOfLevels):
			opening = doc.Create.NewOpening(floorList[level], carray, False)
		
	#Escalators
		for level in range(0,numberOfLevels - 1):
			for number in range(0, numberOfEscalators):
				#left
				escPoint = XYZ(revitApiEscalatorXStartLeft ,revitApiEscalatorYStart + revitApiOrientationOffsetLeft , revitApiPlatformHeight + level * revitApiWallHeight)
				escalator = doc.Create.NewFamilyInstance(escPoint, escalatorType, levelList[level], Autodesk.Revit.DB.Structure.StructuralType.NonStructural)
				escalatorList.append(escalator)
				ZRotateInstance((math.pi/2) + rotationAngle, escalator, escPoint)
				
				#right
				escPoint = XYZ(revitApiEscalatorXStartRight ,revitApiEscalatorYStart + revitApiOrientationOffsetRight , revitApiPlatformHeight + level * revitApiWallHeight)
				escalator = doc.Create.NewFamilyInstance(escPoint, escalatorType, levelList[level], Autodesk.Revit.DB.Structure.StructuralType.NonStructural)
				escalatorList.append(escalator)
				ZRotateInstance((-math.pi/2) + rotationAngle, escalator, escPoint)
				
				#offset for next iteration
				revitApiEscalatorYStart += revitApiEscalatorWidth
		
				#Stairs
				if (number == numberOfEscalators - 1) and (numberOfStairs > 0):		
					#left
					stairPoint = XYZ(revitApiEscalatorXStartLeft, revitApiEscalatorYStart + revitApiStairWidth /2 , revitApiPlatformHeight + level * revitApiWallHeight)
					stairs = doc.Create.NewFamilyInstance(stairPoint, stairType, levelList[level], Autodesk.Revit.DB.Structure.StructuralType.NonStructural)
					stairs.GetParameters("Top Offset")[0].Set(revitApiWallHeight)
					stairs.GetParameters("Step Width")[0].Set(revitApiStairWidth)
					stairs.LookupParameter("accu_rate_type").Set("Stair")
					ZRotateInstance(math.pi*2.5 + rotationAngle, stairs, stairPoint)
					delta = revitApiEscalatorLength - stairs.LookupParameter("Run Length").AsDouble()
					ElementTransformUtils.MoveElement(doc, stairs.Id, XYZ(-delta * wallOrientation, 0 , 0))			
					#right
					stairPoint = XYZ(revitApiEscalatorXStartRight + delta * wallOrientation, revitApiEscalatorYStart + revitApiStairWidth /2 , revitApiPlatformHeight + level * revitApiWallHeight)
					stairs = doc.Create.NewFamilyInstance(stairPoint, stairType, levelList[level], Autodesk.Revit.DB.Structure.StructuralType.NonStructural)
					stairs.GetParameters("Top Offset")[0].Set(revitApiWallHeight)
					stairs.GetParameters("Step Width")[0].Set(revitApiStairWidth)
					stairs.LookupParameter("accu_rate_type").Set("Stair")
					ZRotateInstance(math.pi*1.5 + rotationAngle, stairs, stairPoint)
				else:
					delta = 0
	
			revitApiEscalatorYStart -= revitApiEscalatorWidth*numberOfEscalators	
			
		#Holes for the Escalators
		for level in range(1, numberOfLevels):
			holeYStart = revitApiEscalatorYStart 
			holeYEnd = revitApiEscalatorYStart + numberOfEscalators * revitApiEscalatorWidth + numberOfStairs * revitApiStairWidth
			if level == numberOfLevels -1:
				numberOfStairs2 = 0
				delta = 0
			else:
				numberOfStairs2 = numberOfStairs
			#left
			holePoint1 = XYZ(revitApiEscalatorXStartLeft, holeYStart, level * revitApiWallHeight)
			holePoint2 = XYZ(revitApiEscalatorXStartLeft - revitApiEscalatorLength * wallOrientation, holeYStart, level * revitApiWallHeight)
			holePoint3 = XYZ(revitApiEscalatorXStartLeft - revitApiEscalatorLength * wallOrientation, holeYEnd , level * revitApiWallHeight)
			holePoint4 = XYZ(revitApiEscalatorXStartLeft - delta * wallOrientation, holeYEnd, level * revitApiWallHeight)
			holePoint5 = XYZ(revitApiEscalatorXStartLeft - delta * wallOrientation, holeYEnd - numberOfStairs2 * revitApiStairWidth, level * revitApiWallHeight)
			holePoint6 = XYZ(revitApiEscalatorXStartLeft, holeYEnd - numberOfStairs2 * revitApiStairWidth, level * revitApiWallHeight)
			
			holeLine1 = Autodesk.Revit.DB.Line.CreateBound(holePoint1, holePoint2)
			holeLine2 = Autodesk.Revit.DB.Line.CreateBound(holePoint2, holePoint3)
			holeLine3 = Autodesk.Revit.DB.Line.CreateBound(holePoint3, holePoint4)
			if numberOfStairs == 1 and level < numberOfLevels -1:
				holeLine4 = Autodesk.Revit.DB.Line.CreateBound(holePoint4, holePoint5)
				holeLine5 = Autodesk.Revit.DB.Line.CreateBound(holePoint5, holePoint6)
			holeLine6 = Autodesk.Revit.DB.Line.CreateBound(holePoint6, holePoint1)
			
			carray = CurveArray()	
			carray.Append(holeLine1)
			carray.Append(holeLine2)
			carray.Append(holeLine3)
			if numberOfStairs == 1 and level < numberOfLevels -1:
				carray.Append(holeLine4)
				carray.Append(holeLine5)
			carray.Append(holeLine6)
			doc.Create.NewOpening(floorList[level], carray, False)
			holeList.append(carray)
			#right 
			holePoint1 = XYZ(revitApiEscalatorXStartRight, holeYStart, level * revitApiWallHeight)
			holePoint2 = XYZ(revitApiEscalatorXStartRight + revitApiEscalatorLength * wallOrientation, holeYStart, level * revitApiWallHeight)
			holePoint3 = XYZ(revitApiEscalatorXStartRight + revitApiEscalatorLength * wallOrientation, holeYEnd , level * revitApiWallHeight)
			holePoint4 = XYZ(revitApiEscalatorXStartRight + delta * wallOrientation, holeYEnd, level * revitApiWallHeight)
			holePoint5 = XYZ(revitApiEscalatorXStartRight + delta * wallOrientation, holeYEnd - numberOfStairs2 * revitApiStairWidth, level * revitApiWallHeight)
			holePoint6 = XYZ(revitApiEscalatorXStartRight, holeYEnd - numberOfStairs2 * revitApiStairWidth, level * revitApiWallHeight)
			
			holeLine1 = Autodesk.Revit.DB.Line.CreateBound(holePoint1, holePoint2)
			holeLine2 = Autodesk.Revit.DB.Line.CreateBound(holePoint2, holePoint3)
			holeLine3 = Autodesk.Revit.DB.Line.CreateBound(holePoint3, holePoint4)
			if numberOfStairs == 1 and level < numberOfLevels -1:
				holeLine4 = Autodesk.Revit.DB.Line.CreateBound(holePoint4, holePoint5)
				holeLine5 = Autodesk.Revit.DB.Line.CreateBound(holePoint5, holePoint6)
			holeLine6 = Autodesk.Revit.DB.Line.CreateBound(holePoint6, holePoint1)
			
			carray = CurveArray()
			carray.Append(holeLine1)
			carray.Append(holeLine2)
			carray.Append(holeLine3)
			if numberOfStairs == 1 and level < numberOfLevels -1:
				carray.Append(holeLine4)
				carray.Append(holeLine5)
			carray.Append(holeLine6)
			doc.Create.NewOpening(floorList[level], carray, False)
			holeList.append(carray)
	# Escalator parameter
	for escalator in escalatorList:
		escalator.GetParameters("Top Offset")[0].Set(revitApiWallHeight)
		escalator.LookupParameter("accu_rate_type").Set("Escalator")
		escalator.LookupParameter("tread_width").Set(treadWidth)
		escalator.LookupParameter("Lower Arrow").Set(0)
		escalator.LookupParameter("Upper Arrow").Set(0)
		escalator.LookupParameter("Clearence").Set(0)
	# for columns 
	if escOrientation:
		occupiedXSpaceEscalatorRight =  (xAxisCenter + xAxisEscalator - escExitClearance, xAxisCenter +  xAxisEscalator + escalatorLength)
		occupiedXSpaceEscalatorLeft = (xAxisCenter - xAxisEscalator - escalatorLength, xAxisCenter - xAxisEscalator + escExitClearance)
	else:
		occupiedXSpaceEscalatorLeft =  (xAxisCenter - xAxisEscalator - escExitClearance, xAxisCenter -  xAxisEscalator + escalatorLength)
		occupiedXSpaceEscalatorRight = (xAxisCenter + xAxisEscalator - escalatorLength, xAxisCenter + xAxisEscalator + escExitClearance)
	occupiedXSpacesList = [occupiedXSpaceElevator, occupiedXSpaceEscalatorLeft, occupiedXSpaceEscalatorRight]
	
	occupiedYSpacesEscalator = (minDistToEdge, platformWidth - minDistToEdge)
	occupiedYSpaceElevator = (platformWidth/2 - elevatorLength/2, platformWidth/2 + elevatorLength/2)
	occupiedYSpacesList = [occupiedYSpaceElevator, occupiedYSpacesEscalator]
	
	# place walls around the escalator holes platformCount*numberOfLevels
	if numberOfLevels ==4:
		hList = holeList[numberOfLevels::(numberOfLevels-1)*2] + holeList[numberOfLevels+1::(numberOfLevels-1)*2]
	elif numberOfLevels == 3:
		hList = holeList[numberOfLevels::(numberOfLevels-1)*2] + holeList[numberOfLevels-1::(numberOfLevels-1)*2]
	else:
		hList = holeList
	
	for carray in hList:
		# don't place walls in front if the escalator
		for i in range(0, 4):
			for k in range(1, numberOfLevels):
				level2 = UnwrapElement(levelList[k])
				if (i == 3 and escOrientation == 1 and k == numberOfLevels -1) or (i == 3 and escOrientation == 0 and k == numberOfLevels -1) or i ==2 or i==0:
					line = carray[i]
					wall = Autodesk.Revit.DB.Wall.Create(doc, line, wallType.Id, level2.Id, 3.3, 0, False, False)
					if i == 2:
						wall.Location.Move(XYZ(0, wallType.Width/2, 0))
					elif i == 0:
						wall.Location.Move(XYZ(0, -wallType.Width/2, 0))		
	####################################################################################################################################################################################
	####################################################################################################################################################################################
	#columns
	####################################################################################################################################################################################
	####################################################################################################################################################################################
	columnWidth = 0.75 #[m]
	safetyStripWidth += (0.9 + columnWidth/2) # 0.9 m Ril 813.0201A04 3(3) for small obstacles
	revitApiFloorThickness = UnitUtils.ConvertToInternalUnits(0.2, DisplayUnitType.DUT_METERS)
	
	if columnRows > 0:
		columnCountLeft  = int( math.floor(xAxisCenter / columnSpacing)) #split because xAxisCenter not always in the middle and columns should be center orientated
		columnCountRight = int( math.floor((length - xAxisCenter)/ columnSpacing) + 1)
		columnStartX = xAxisCenter - columnCountLeft * columnSpacing
		columnXListBefore = []
		for i in range(0,(columnCountLeft + columnCountRight)):
			columnXListBefore.append(i * columnSpacing + columnStartX)
	
		# Clash detection with occupiedYSpaces; only for escalators
		occupiedXSpacesColumnList = list(occupiedXSpacesList)
		if columnRows > 1:
			if occupiedYSpacesList[1][0] > (safetyStripWidth + columnWidth/2) and occupiedYSpacesList[1][1] > (platformCount - (safetyStripWidth + columnWidth/2)):
				del occupiedXSpacesColumnList[1:3]
	
		# Clash detection with occupiedXSpaces
		columnXList = [] 
		for x in columnXListBefore:
			i = 0
			for space in occupiedXSpacesColumnList:
				if not(x > space[0] and x < space[1]):
					i += 1
				if i == len(occupiedXSpacesColumnList):
					columnXList.append(x)
		# YAxis
		columnYList = []
		for p in range(platformCount):
			if columnRows == 2:
				columnYList.append(yAxisList[p] + safetyStripWidth)
				columnYList.append(yAxisList[p] + platformWidth - safetyStripWidth)
			elif columnRows == 1:
				columnYList.append(yAxisList[p] + platformWidth/2)
				
		for x in columnXList:
			for y in columnYList:
				revitApiX = UnitUtils.ConvertToInternalUnits(x, DisplayUnitType.DUT_METERS)
				revitApiY = UnitUtils.ConvertToInternalUnits(y, DisplayUnitType.DUT_METERS)
				basePoint = XYZ(revitApiX, revitApiY, 0)
				topHeight = revitApiWallHeight - revitApiFloorThickness
				column = doc.Create.NewFamilyInstance(basePoint, columnType,  levelEG, Autodesk.Revit.DB.Structure.StructuralType.NonStructural)
				column.LookupParameter("Enable Analytical Model").Set(0)
				column.LookupParameter("Top Offset").Set(topHeight)
				column.LookupParameter("Top Level").Set(levelEG.Id)
	####################################################################################################################################################################################
	####################################################################################################################################################################################
	#Top Decoration
	####################################################################################################################################################################################
	####################################################################################################################################################################################
	revitApiExitXOffset = UnitUtils.ConvertToInternalUnits(exitXOffset, DisplayUnitType.DUT_METERS)
	revitApiTicketXOffset = UnitUtils.ConvertToInternalUnits(ticketXOffset, DisplayUnitType.DUT_METERS)
	revitApiTicketWidth = UnitUtils.ConvertToInternalUnits(0.8, DisplayUnitType.DUT_METERS)
	revitApiStoreWidth = UnitUtils.ConvertToInternalUnits(5, DisplayUnitType.DUT_METERS)
	revitApiRailingHeight = UnitUtils.ConvertToInternalUnits(1.2, DisplayUnitType.DUT_METERS)
	
	# Define points where exits are inserted
	exitPoint1 = XYZ(revitApiExitXOffset, UnitUtils.ConvertToInternalUnits(7, DisplayUnitType.DUT_METERS), 0)	# 7m = exitOffset in Y = inwards
	exitPoint2 = XYZ(revitApiLength - revitApiExitXOffset, UnitUtils.ConvertToInternalUnits(7, DisplayUnitType.DUT_METERS), 0)
	exitPoint3 = XYZ(revitApiLength - revitApiExitXOffset - revitApiEscalatorWidth, revitApiWidth - UnitUtils.ConvertToInternalUnits(7, DisplayUnitType.DUT_METERS), 0)
	exitPoint4 = XYZ(revitApiExitXOffset - revitApiEscalatorWidth, revitApiWidth - UnitUtils.ConvertToInternalUnits(7, DisplayUnitType.DUT_METERS), 0)
	pointList = [exitPoint1, exitPoint2, exitPoint3, exitPoint4]
		
	# Start the transaction
	decorationList = []
	if numberOfLevels > 1:
		topLevel = list(levelList)[-2]
		
		# Place ATMs
		aPoint1 = XYZ(UnitUtils.ConvertToInternalUnits(xAxisCenter, DisplayUnitType.DUT_METERS), 1, 0)
		aPoint2 = XYZ(UnitUtils.ConvertToInternalUnits(xAxisCenter, DisplayUnitType.DUT_METERS), revitApiWidth - 3, 0)
		aPointList = [aPoint1, aPoint2]
		atm = doc.Create.NewFamilyInstance(aPoint1, atmType, topLevel, Autodesk.Revit.DB.Structure.StructuralType.NonStructural)
		decorationList.append(atm)
		atm = doc.Create.NewFamilyInstance(aPoint2, atmType, topLevel, Autodesk.Revit.DB.Structure.StructuralType.NonStructural)
		decorationList.append(atm)
		
		# Place TIcketmachines
		for point in aPointList:
			for machineNr in range(0, nrOfMachines):
				mPoint = XYZ(point.X - machineNr*revitApiTicketWidth + revitApiTicketXOffset, point.Y, point.Z)
				machine = doc.Create.NewFamilyInstance(mPoint, ticketType, topLevel, Autodesk.Revit.DB.Structure.StructuralType.NonStructural)
				decorationList.append(machine)
			for machineNr in range(0, nrOfMachines):
				mPoint = XYZ(point.X + machineNr*revitApiTicketWidth - revitApiTicketXOffset, point.Y, point.Z)
				machine = doc.Create.NewFamilyInstance(mPoint, ticketType, topLevel, Autodesk.Revit.DB.Structure.StructuralType.NonStructural)
				decorationList.append(machine)
				
		# Place Ticketvalidators
		if escOrientation:
			xLeft  = occupiedXSpacesList[1][0] - escExitClearance
			xRight = occupiedXSpacesList[2][1] + escExitClearance
			yLeft  = [revitApiEscalatorWidth * i + UnitUtils.ConvertToInternalUnits(occupiedYSpacesList[1][0], DisplayUnitType.DUT_METERS) for i in range(numberOfEscalators + 1)]
			yRight = [revitApiEscalatorWidth * i + revitApiEscalatorWidth + UnitUtils.ConvertToInternalUnits(occupiedYSpacesList[1][0], DisplayUnitType.DUT_METERS) for i in range(numberOfEscalators)]
			yRight.append(yRight[-1] + revitApiStairWidth)
		else:
			xLeft  = occupiedXSpacesList[1][1] + escExitClearance
			xRight = occupiedXSpacesList[2][0] - escExitClearance
			yRight = [revitApiEscalatorWidth * i + UnitUtils.ConvertToInternalUnits(occupiedYSpacesList[1][0], DisplayUnitType.DUT_METERS) for i in range(numberOfEscalators + 1)]
			yLeft  = [revitApiEscalatorWidth * i + revitApiEscalatorWidth + UnitUtils.ConvertToInternalUnits(occupiedYSpacesList[1][0], DisplayUnitType.DUT_METERS) for i in range(numberOfEscalators)]
			yLeft.append(yLeft[-1] + revitApiStairWidth)
		if numberOfStairs == 0:
			del yRight[-1]
			del yLeft[-1]
		for baseY in revitApiYAxisList:	
			for y in range(len(yLeft)):
				pointLeft  = XYZ(UnitUtils.ConvertToInternalUnits(xLeft , DisplayUnitType.DUT_METERS), yLeft[y]  + baseY, 0)
				pointRight = XYZ(UnitUtils.ConvertToInternalUnits(xRight, DisplayUnitType.DUT_METERS), yRight[y] + baseY, 0)
				validatorLeft  = doc.Create.NewFamilyInstance(pointLeft , validatorType, topLevel, Autodesk.Revit.DB.Structure.StructuralType.NonStructural)
				validatorRight = doc.Create.NewFamilyInstance(pointRight, validatorType, topLevel, Autodesk.Revit.DB.Structure.StructuralType.NonStructural)
				decorationList.append(validatorLeft)
				decorationList.append(validatorRight)
			
		# place escalators as exits + ticketmachines
		for exitNumber in range(0, numberOfExits):
			escalator = doc.Create.NewFamilyInstance(pointList[exitNumber], escalatorType, topLevel, Autodesk.Revit.DB.Structure.StructuralType.NonStructural)
			escalator.LookupParameter("accu_rate_type").Set("Escalator")
			escalator.LookupParameter("tread_width").Set(treadWidth)
			escalator.LookupParameter("Lower Arrow").Set(0)
			escalator.LookupParameter("Upper Arrow").Set(0)
			escalator.LookupParameter("Clearence").Set(0)
			
			stairPoint = XYZ(pointList[exitNumber].X + revitApiStairWidth/2, pointList[exitNumber].Y, 0)
			stairs = doc.Create.NewFamilyInstance(stairPoint, stairType, topLevel, Autodesk.Revit.DB.Structure.StructuralType.NonStructural)
			stairs.GetParameters("Step Width")[0].Set(revitApiStairWidth)
			stairs.LookupParameter("accu_rate_type").Set("Stair")
	
			delta = (escalator.LookupParameter("Length").AsDouble() - UnitUtils.ConvertToInternalUnits(1.7, DisplayUnitType.DUT_METERS)) #beginning of the surface slab (abs)
			surfaceSlabMeasure = UnitUtils.ConvertToInternalUnits(6, DisplayUnitType.DUT_METERS) #Arbitrary
			
			if exitNumber<2:	
				floorYOffset  = - delta
				floorYOffset2 = - surfaceSlabMeasure
				ZRotateInstance(math.pi, escalator, pointList[exitNumber])
				ZRotateInstance(math.pi, stairs, stairPoint)
				stairs.Location.Move(XYZ(0, floorYOffset + stairs.LookupParameter("Run Length").AsDouble() , 0))
					
				#create the opening in the wall
				o1 = XYZ(pointList[exitNumber].X + revitApiStairWidth, 0,  UnitUtils.ConvertToInternalUnits(1.17, DisplayUnitType.DUT_METERS) + revitApiWallHeight * (numberOfLevels - 1))
				o2 = XYZ(pointList[exitNumber].X - revitApiEscalatorWidth, 0, UnitUtils.ConvertToInternalUnits(5, DisplayUnitType.DUT_METERS) + revitApiWallHeight * (numberOfLevels))
				opening = doc.Create.NewOpening(UnwrapElement(wallList[0]), o1, o2)
				
				# place storebooths
				if exitNumber == 1:
					bpoint = XYZ(pointList[exitNumber].X - revitApiStoreWidth - revitApiEscalatorWidth - 30, 1, 0)
				else:
					bpoint = XYZ(pointList[exitNumber].X + revitApiEscalatorWidth + 30, 1, 0)
				storeBooth = doc.Create.NewFamilyInstance(bpoint, storeType, topLevel, Autodesk.Revit.DB.Structure.StructuralType.NonStructural)
				decorationList.append(storeBooth)			
			else:
				floorYOffset  = delta
				floorYOffset2 = surfaceSlabMeasure
				stairs.Location.Move(XYZ(revitApiEscalatorWidth, floorYOffset - stairs.LookupParameter("Run Length").AsDouble() , 0))
				
				#create the opening in the wall
				o1 = XYZ(pointList[exitNumber].X, 0, UnitUtils.ConvertToInternalUnits(1, DisplayUnitType.DUT_METERS) + revitApiWallHeight * (numberOfLevels - 1))
				o2 = XYZ(pointList[exitNumber].X + revitApiEscalatorWidth + revitApiStairWidth, 0, UnitUtils.ConvertToInternalUnits(5, DisplayUnitType.DUT_METERS) + revitApiWallHeight*(numberOfLevels))
				opening = doc.Create.NewOpening(UnwrapElement(wallList[2]), o1, o2)
			
			#Surface slab
			point1 = XYZ(pointList[exitNumber].X - surfaceSlabMeasure, pointList[exitNumber].Y + floorYOffset, (numberOfLevels - 1) * revitApiWallHeight + UnitUtils.ConvertToInternalUnits(4.5, DisplayUnitType.DUT_METERS))
			point2 = XYZ(pointList[exitNumber].X + surfaceSlabMeasure, pointList[exitNumber].Y + floorYOffset, (numberOfLevels - 1) * revitApiWallHeight + UnitUtils.ConvertToInternalUnits(4.5, DisplayUnitType.DUT_METERS))
			point3 = XYZ(pointList[exitNumber].X + surfaceSlabMeasure, pointList[exitNumber].Y + floorYOffset + floorYOffset2, (numberOfLevels - 1) * revitApiWallHeight + UnitUtils.ConvertToInternalUnits(4.5, DisplayUnitType.DUT_METERS))
			point4 = XYZ(pointList[exitNumber].X - surfaceSlabMeasure, pointList[exitNumber].Y + floorYOffset + floorYOffset2, (numberOfLevels - 1) * revitApiWallHeight + UnitUtils.ConvertToInternalUnits(4.5, DisplayUnitType.DUT_METERS))
			line1 = Autodesk.Revit.DB.Line.CreateBound(point1, point2)
			line2 = Autodesk.Revit.DB.Line.CreateBound(point2, point3)
			line3 = Autodesk.Revit.DB.Line.CreateBound(point3, point4)
			line4 = Autodesk.Revit.DB.Line.CreateBound(point4, point1)
			carray = CurveArray()
			carray.Append(line1)
			carray.Append(line2)
			carray.Append(line3)
			carray.Append(line4)
			floor = doc.Create.NewFloor(carray, floorType, list(levelList)[-1], False)
			floor.LookupParameter("accu_rate_type").Set("Destination")	
	
	#End Transaction
	TransactionManager.Instance.TransactionTaskDone()
	# Assign your output to the OUT variable.
	output = IN[0]
	output[0].append(xAxisCenter)
	output[3].append(occupiedXSpacesList)
	output[3].append(occupiedYSpacesList)
	output[3].append(decorationList)
	OUT = output

else:
	OUT = []
# ----------------------------------------
end = Revit.Transaction.Transaction.End(input=main_create_script)

# group: Floor Plan Creation + Export
start_2 = Revit.Transaction.Transaction.Start(input=end)
colored_views = BoolSelector(true)
obstacles = ColorPalette({R: 0, G: 0, B: 255, A: 255})
origin_zones = ColorPalette({R: 255, G: 0, B: 0, A: 255})
destination_zones = ColorPalette({R: 0, G: 252, B: 0, A: 255})
vertical_transportation = ColorPalette({R: 255, G: 255, B: 0, A: 255})
walkable_floors = ColorPalette({R: 255, G: 255, B: 255, A: 255})
view_manager = Python(IN[0]=start_2, IN[1]=colored_views, IN[2]=obstacles, IN[3]=origin_zones, IN[4]=destination_zones, IN[5]=vertical_transportation, IN[6]=walkable_floors, IN[7]=onlyExport, IN[8]=export_floorplans)  # IronPython2
# ---------- view_manager.python (146 lines) ----------
# Load the Python Standard and DesignScript Libraries
import sys
import clr
import time
clr.AddReference('ProtoGeometry')
from Autodesk.DesignScript.Geometry import *

#Import Revit Nodes
clr.AddReference("RevitNodes")
import Revit
clr.ImportExtensions(Revit.Elements)
clr.ImportExtensions(Revit.GeometryConversion)

clr.AddReference("RevitAPI")

from Autodesk.Revit.DB import *
from Autodesk.Revit.DB.Architecture import *

clr.AddReference("RevitServices")
from RevitServices.Persistence import DocumentManager
from RevitServices.Transactions import TransactionManager

clr.AddReference("System")
from System.Collections.Generic import List

# functions
def ConvertColor(e):
	return Color(e.Red, e.Green, e.Blue)

def OverrideColorPattern(element, color, pattern, view):
	graphicSettings = OverrideGraphicSettings()
	graphicSettings.SetSurfaceForegroundPatternColor(color)
	graphicSettings.SetCutForegroundPatternColor(color)
	graphicSettings.SetSurfaceForegroundPatternId(UnwrapElement(pattern).Id)
	graphicSettings.SetCutForegroundPatternId(UnwrapElement(pattern).Id)
	UnwrapElement(view).SetElementOverrides(element.Id, graphicSettings)
	
# The inputs to this node will be stored as a list in the IN variables.
onlyExport = IN[7]

if not onlyExport:
    listList = IN[0][3]
    levelList = UnwrapElement(listList[0])
    decorationList = UnwrapElement(listList[8])
    familyTypes = IN[0][6]
else:
    docData = IN[8]
    levelList = UnwrapElement(docData[0])
    familyTypes = docData[1]
    decorationList = []

doc = DocumentManager.Instance.CurrentDBDocument
TransactionManager.Instance.EnsureInTransaction(doc)
# Place your code below this line
floorTypes = FilteredElementCollector(doc).OfClass(ViewFamilyType).ToElements();
floorId = UnwrapElement( floorTypes[0]).Id

viewList = []

for level in levelList:
    view = ViewPlan.Create(doc, floorId, level.Id)
    
    view.HideElements(List[ElementId](FilteredElementCollector(doc).OfCategory(BuiltInCategory.OST_Elev).ToElementIds()))
    view.HideElements(List[ElementId](FilteredElementCollector(doc).OfCategory(BuiltInCategory.OST_Viewers).ToElementIds()))
    view.CropBoxActive = True
    viewRange = view.GetViewRange()
    viewRange.SetOffset(PlanViewPlane.ViewDepthPlane, -5)
    view.SetViewRange(viewRange)
    viewList.append(view)
    
    #########################################################
    #########################################################
    # Coloured Views
obstacleColor = ConvertColor(IN[2])
originColor = ConvertColor(IN[3])
destinationColor = ConvertColor(IN[4])
verticalTransportationColor = ConvertColor(IN[5])
walkableFloorColor = ConvertColor(IN[6])

#get all elements
walkableFloors = FilteredElementCollector(doc).OfCategory(BuiltInCategory.OST_Floors)
walls = FilteredElementCollector(doc).OfCategory(BuiltInCategory.OST_Walls)
columns = FilteredElementCollector(doc).OfCategory(BuiltInCategory.OST_StructuralColumns)
generalModels = FilteredElementCollector(doc).OfCategory(BuiltInCategory.OST_GenericModel).OfClass(FamilyInstance).ToElements()
verticalTransportationElements = []
origins = []
trainWalls = []
for element in generalModels:
    if element.Name == familyTypes[3].Name or element.Name == familyTypes[4].Name:
        verticalTransportationElements.append(element)
    elif element.Name == familyTypes[5].Name:
        origins.append(element)
    elif element.Name == familyTypes[6].Name:
        trainWalls.append(element)
    
# solid fill pattern
fillPatterns = FilteredElementCollector(doc).OfClass(FillPatternElement)
for pattern in fillPatterns:
    if UnwrapElement(pattern).GetFillPattern().IsSolidFill:
        solidPattern = pattern
        break
viewListColour = []
if IN[1]:
    viewTypes = FilteredElementCollector(doc).OfClass(ViewFamilyType).ToElements();
    viewTypeId = UnwrapElement( viewTypes[0]).Id

    
    
    for level in levelList:
        view = ViewPlan.Create(doc, viewTypeId, level.Id)
        view.Name = view.Name + " Coloured"
        view.Name = view.Name.Replace("(1)"," ")
        view.HideElements(List[ElementId](FilteredElementCollector(doc).OfCategory(BuiltInCategory.OST_Elev).ToElementIds()))
        view.HideElements(List[ElementId](FilteredElementCollector(doc).OfCategory(BuiltInCategory.OST_Viewers).ToElementIds()))
        view.CropBoxActive = True
        viewRange = view.GetViewRange()
        viewRange.SetOffset(PlanViewPlane.ViewDepthPlane, -5)
        view.SetViewRange(viewRange)
        view.DetailLevel = ViewDetailLevel.Medium
        viewListColour.append(view)

    #Apply Color
        for floor in walkableFloors:
            OverrideColorPattern(floor, walkableFloorColor, solidPattern, view)
            if floor.LookupParameter("accu_rate_type") is not None:
                if floor.LookupParameter("accu_rate_type").AsString() == "Destination":
                    OverrideColorPattern(floor, destinationColor, solidPattern, view)
                elif floor.LookupParameter("accu_rate_type").AsString() == "Origin":
                    OverrideColorPattern(floor, originColor, solidPattern, view)
                
        for wall in walls:
            OverrideColorPattern(wall, obstacleColor, solidPattern, view)
        for column in columns:
            OverrideColorPattern(column, obstacleColor, solidPattern, view)
        for deco in decorationList:
            OverrideColorPattern(deco, obstacleColor, solidPattern, view)
        for vert in verticalTransportationElements:
            OverrideColorPattern(vert, verticalTransportationColor, solidPattern, view)
        for origin in origins:
            OverrideColorPattern(origin, originColor, solidPattern, view)
        for wall in trainWalls:
            OverrideColorPattern(wall, obstacleColor, solidPattern, view)

TransactionManager.Instance.TransactionTaskDone()
# Assign your output to the OUT variable.
OUT = viewList, viewListColour
# ----------------------------------------
end_2 = Revit.Transaction.Transaction.End(input=view_manager)
directory_path = Directory("C:\Users\ga78jem\Documents\Revit\U9-Dynamo\U9 Temp")
subfolders = BoolSelector(false)
folder_name = StringInput("Test_")
number_suffix = BoolSelector(false)
view_export = BoolSelector(false)
color_export = BoolSelector(false)
ifc_export = BoolSelector(false)
export_mapping = Filename("Shared Parameters and IFC Mapping\ExportIFCMappings.txt")
dwg_export = BoolSelector(false)
log_export = BoolSelector(false)
export_manager = Python(IN[0]=end_2, IN[1]=directory_path, IN[2]=subfolders, IN[3]=folder_name, IN[4]=number_suffix, IN[5]=view_export, IN[6]=color_export, IN[7]=ifc_export, IN[8]=export_mapping, IN[9]=dwg_export, IN[10]=log_export, IN[11]=if_export_only_eg)  # IronPython2
# ---------- export_manager.python (136 lines) ----------
# Load the Python Standard and DesignScript Libraries
import sys
import clr
import os
import time
clr.AddReference('ProtoGeometry')
from Autodesk.DesignScript.Geometry import *

#Import Revit Nodes
clr.AddReference("RevitNodes")
import Revit
clr.ImportExtensions(Revit.Elements)
clr.ImportExtensions(Revit.GeometryConversion)

clr.AddReference("RevitAPI")
from Autodesk.Revit.DB import *
from Autodesk.Revit.DB.Architecture import *

clr.AddReference("RevitServices")
from RevitServices.Persistence import DocumentManager
from RevitServices.Transactions import TransactionManager

clr.AddReference("System")
from System.Collections.Generic import List
# The inputs to this node will be stored as a list in the IN variables.
viewList = IN[0][0]
viewColorList = IN[0][1]
path = IN[1]
folderName = IN[3]

doc = DocumentManager.Instance.CurrentDBDocument
TransactionManager.Instance.EnsureInTransaction(doc)
# Place your code below this line

# custom:
onlyExportEG = IN[11]

floorTypes = FilteredElementCollector(doc).OfClass(ViewFamilyType).ToElements();
floorId = UnwrapElement( floorTypes[0]).Id

if IN[2] and (IN[5] or IN[6] or IN[7] or IN[9] or IN[10]):	
	if IN[4]:
		folders = os.listdir(path)
		maxNumber = -1
		for folder in folders:
			try:
				maxNumber = max(int(folder.split(folderName)[1]),maxNumber)
			except:
				print("Folder Error")
		maxNumber += 1
		folderName += str(maxNumber)
	path= os.path.join(path, folderName)
	if not os.path.exists(path):
		os.makedirs(path)
##########################################################################
##########################################################################
#View Export
##########################################################################
##########################################################################
exportPath = path
fileName = "Test"
filePath = os.path.join(exportPath, fileName)

viewIdList = [view.Id for view in UnwrapElement(viewList)]
# custom:
if onlyExportEG:
	viewIdList = [view.Id for view in UnwrapElement(viewList) if view.Name.startswith("EG")]
if IN[5]:
	options = ImageExportOptions()
	options.FilePath = filePath
	options.ExportRange = ExportRange.SetOfViews
	options.SetViewsAndSheets(viewIdList)
	options.HLRandWFViewsFileType = ImageFileType.PNG
	options.PixelSize = 2500
	options.ImageResolution = ImageResolution.DPI_600
	options.FitDirection = FitDirectionType.Horizontal
	options.ZoomType = ZoomFitType.FitToPage
	doc.ExportImage(options)
#ColorViews
viewColorIdList = [view.Id for view in UnwrapElement(viewColorList)]
# custom:
if onlyExportEG:
	viewColorIdList = [view.Id for view in UnwrapElement(viewColorList) if view.Name.startswith("EG")]
if IN[6]:
	options = ImageExportOptions()
	options.FilePath = filePath
	options.ExportRange = ExportRange.SetOfViews
	options.SetViewsAndSheets(viewColorIdList)
	options.HLRandWFViewsFileType = ImageFileType.PNG
	options.PixelSize = 5000
	options.ImageResolution = ImageResolution.DPI_600
	options.FitDirection = FitDirectionType.Horizontal
	options.ZoomType = ZoomFitType.FitToPage
	doc.ExportImage(options)
##########################################################################
##########################################################################
# IFC Export
##########################################################################
##########################################################################
if IN[7]:
	options=IFCExportOptions()
	options.FileVersion = IFCVersion.IFC2x3CV2
	options.AddOption("ExportUserDefinedPsets","true")
	options.AddOption("ExportInternalRevitPropertySets","false")
	options.AddOption("ExportBaseQuantitiesPsets","false")
	options.AddOption("ExportExportIFCCommonPropertySets","false")
	options.AddOption("ExportUserDefinedPsetsFileName",str(IN[8]))
		
	c=doc.Export(exportPath, fileName, options)
##########################################################################
##########################################################################
#Dwg Export
##########################################################################
##########################################################################
#viewIdList = List[ElementId]([view.Id for view in UnwrapElement(viewList)])
if IN[9]:
	options = DWGExportOptions()
	doc.Export(exportPath, fileName, List[ElementId](viewIdList), options)
##########################################################################
##########################################################################
#Log Export
##########################################################################
##########################################################################
if IN[10]:
	stdout_original = sys.stdout
	stdout_file = open(exportPath + "/Log.txt", 'a')
	sys.stdout = stdout_file
	
	print("This is a filler... da da da")

	sys.stdout = stdout_original
	stdout_file.close()
	
TransactionManager.Instance.TransactionTaskDone()
# Assign your output to the OUT variable.
OUT = viewList, viewColorList, path, filePath+" - Floor Plan - EG  Coloured.png"
# ----------------------------------------

image_display = Python(IN[0]=export_manager)  # IronPython2
# ---------- image_display.python (30 lines) ----------
import clr
import System
from System.IO import *
clr.AddReference('ProtoGeometry')
from Autodesk.DesignScript.Geometry import *

clr.AddReference("RevitServices")
import RevitServices
from RevitServices.Persistence import DocumentManager 

clr.AddReference("RevitAPI")
from Autodesk.Revit.DB import *

clr.AddReference('System.Drawing')
import System.Drawing
from System.Drawing import *

# The inputs to this node will be stored as a list in the IN variables.
dataEnteringNode = IN

# Place your code below this line
filePath = IN[0][-1]

#filePath = 'C:\\Users\\ga78jem\\Documents\\PhD\\Publications\\PED2023\\Figures\\T4_E2_S0_O1_A10_C0.png'
filePath = 'C:\\Users\\ga78jem\\Documents\\PhD\\Publications\\PED2023\\Figures\\bim_impl\\T4_E2_S0_O1_A10_C2_edited.png'

result = Image.FromFile(filePath)

# Assign your output to the OUT variable.
OUT = result
# ----------------------------------------
colored_floorplan = WatchImageCore(image=image_display)

# group: Neural Network Group
checkpoint_path = Filename("..\..\best_model.ckpt")
virtual_environment = Directory("C:\Users\ga78jem\miniconda\envs\venv_torch")

image_loader = Python(IN[0]=virtual_environment, IN[1]=export_manager)  # IronPython2
# ---------- image_loader.python (72 lines) ----------
import clr
import System
import sys
import os
from System.IO import *
clr.AddReference('ProtoGeometry')
from Autodesk.DesignScript.Geometry import *

clr.AddReference("RevitServices")
import RevitServices
from RevitServices.Persistence import DocumentManager 

clr.AddReference("RevitAPI")
from Autodesk.Revit.DB import *
import tempfile

# environment_folder = IN[0]
environment_folder = "C:\\Users\\ga78jem\\AppData\\Local\\miniconda3\\envs\\python38_torch"

loaded_image = None

OUT = [environment_folder, loaded_image]
#package_path = environment_folder+"\\lib\\site-packages"

#sys.path.append(package_path)
#import cv2
#import numpy as np

#OUT = sys.path

"""
if UnwrapElement(IN[0]) and IN[1] : 
    package_path = fr"{IN[1]}\lib\site-packages"
    sys.path.append(package_path)
    import cv2
    import numpy as np

    image_path = UnwrapElement(IN[0])
    image = cv2.imread(image_path)
    image_height , image_width , _ = image.shape

    padded_image_width = int(IN[2])
    padded_image_height = int(IN[3])

    site_x = 25
    site_y = 20
    new_image_dimensions = [site_x * 10 , site_y * 10]
    
    padded_image = np.zeros((padded_image_height, padded_image_width , 3), dtype=np.uint8)
    padded_image_centers = [
        int(dim / 2) for dim in [padded_image_width , padded_image_height]
    ]

    # using different interpolation order for upsizing and downsizing
    if site_x * 10 > image_width and site_y * 10 > image_height : 
        scaled_image = cv2.resize(image, tuple(new_image_dimensions), interpolation=cv2.INTER_CUBIC)
    else : 
        scaled_image = cv2.resize(image, tuple(new_image_dimensions), interpolation=cv2.INTER_AREA)

    origin_in_padded_image = [
        int(padded_image_centers[i] - new_image_dimensions[i] / 2) for i in range(2)
    ]

    padded_image[
        origin_in_padded_image[1] : origin_in_padded_image[1] + new_image_dimensions[1] , origin_in_padded_image[0] : origin_in_padded_image[0] + new_image_dimensions[0]
    ] = scaled_image

    padded_image_path = tempfile.mktemp(suffix=".png")
    cv2.imwrite(padded_image_path , padded_image)

    OUT = padded_image_path
"""
# ----------------------------------------

# group (continued): Neural Network Group
forward_pass = Python(IN[0]=checkpoint_path, IN[1]=crowdit_list, IN[2]=image_loader)  # CPython3
# ---------- forward_pass.python (502 lines) ----------
# Load the Python Standard and DesignScript Libraries
import sys
import os
import clr

clr.AddReference('ProtoGeometry')
from Autodesk.DesignScript.Geometry import *

# The inputs to this node will be stored as a list in the IN variables.
dataEnteringNode = IN

# Place your code below this line
#ckpt_path = IN[0]
#virt_env_path = r"C:\Users\ga78jem\AppData\Local\miniconda3\envs\CritAreaPred_py39" #CritAreaPrediction"# IN[2][0]
#img = IN[2][1]
#num_agents = IN[1]

#package_path = os.path.join(os.getenv(r'LOCALAPPDATA'), r'python-3.8.3-embed-amd64\Lib\site-packages')
#sys.path.append(package_path)
import torch
import math
from transformers import DetrForObjectDetection, DetrConfig
from transformers.models.detr.modeling_detr import BaseModelOutput, DetrModelOutput, DetrObjectDetectionOutput, DETR_INPUTS_DOCSTRING, _CONFIG_FOR_DOC
from transformers.utils.doc import add_start_docstrings_to_model_forward, replace_return_docstrings


# neural network classes
class Detr_custom(DetrForObjectDetection):
    def __init__(self, config = None):
        config=DetrConfig()
        super().__init__(config)
        self.overwrite_functions()
        
        self.class_labels_classifier = torch.nn.Linear(self.model.config.d_model, 2) # detection + no_detection
        self.model.config.num_labels = 1
        self.embed_dim = 256
        # 'vanilla', 'vanilla_imgAugm', 'before_encoder', 'after_encoder', 'before_encoder+', 'after_encoder+'
        self.additional_queries = 'after_encoder'
        
        # if not the original DETR implementation...
        if self.additional_queries not in ['vanilla', 'vanilla_imgAugm']:
            self.num_extra_queries = 100
            if not self.additional_queries.endswith('+'):
                self.central_ascent_embeddings, self.sides_ascent_embeddings = None, None
                self.agent_embeddings = torch.nn.Embedding(3, self.embed_dim)
            else:
                self.agent_embeddings = torch.nn.Embedding(3, self.embed_dim) 
                self.central_ascent_embeddings = torch.nn.Embedding(7, self.embed_dim) # additional 7 options (E=1/2/3 + S=0/2.4 + None) both for vertical ascent in the center and from the sides
                self.sides_ascent_embeddings = torch.nn.Embedding(7, self.embed_dim)
                self.obstacle_presence_embeddings = torch.nn.Embedding(2, self.embed_dim)
            self.model.backbone.position_embedding = DetrSinePositionEmbedding_custom(self.config.d_model // 2, normalize=True, num_extra_queries=self.num_extra_queries)
        else:
            self.num_extra_queries = None

        # for tuning...
        k_decoder_queries = 100
        if k_decoder_queries != self.model.query_position_embeddings.num_embeddings:
            self.model.query_position_embeddings = torch.nn.Embedding(k_decoder_queries, self.model.config.d_model)

            

    def overwrite_functions(self):
        self.forward = self.forward
        self.model.forward = self.model_forward
        
        for enc_layer in self.model.encoder.layers:
            self_attn = enc_layer._modules['self_attn']
            self_attn.with_pos_embed = self.with_pos_embed_overwritten
        for dec_layer in self.model.decoder.layers:
            self_attn = dec_layer._modules['self_attn']
            self_attn.with_pos_embed = self.with_pos_embed_overwritten
            enc_attn = dec_layer._modules['encoder_attn']
            enc_attn.with_pos_embed = self.with_pos_embed_overwritten

    def with_pos_embed_overwritten(self, tensor: torch.Tensor, position_embeddings: torch.Tensor):
        if position_embeddings is None:
            return tensor
        elif tensor.size() == position_embeddings.size():
            return tensor + position_embeddings
        elif tensor.shape[1] < position_embeddings.shape[1]:
            return tensor + position_embeddings[:, :tensor.size(1), :]
        else:
            raise NotImplementedError
           
    
    #################################################################################
    # MODEL FORWARD #################################################################
    #################################################################################
    @add_start_docstrings_to_model_forward(DETR_INPUTS_DOCSTRING)
    @replace_return_docstrings(output_type=DetrModelOutput, config_class=_CONFIG_FOR_DOC)
    def model_forward(
        self,
        pixel_values,
        simulation_embeddings=None, # added to original code
        pixel_mask=None,
        decoder_attention_mask=None,
        encoder_outputs=None,
        inputs_embeds=None,
        decoder_inputs_embeds=None,
        output_attentions=None,
        output_hidden_states=None,
        return_dict=None,
    ):
        
        r"""
        Returns:

        Examples:

        ```python
        >>> from transformers import DetrFeatureExtractor, DetrModel
        >>> from PIL import Image
        >>> import requests

        >>> url = "http://images.cocodataset.org/val2017/000000039769.jpg"
        >>> image = Image.open(requests.get(url, stream=True).raw)

        >>> feature_extractor = DetrFeatureExtractor.from_pretrained("facebook/detr-resnet-50")
        >>> model = DetrModel.from_pretrained("facebook/detr-resnet-50")

        >>> # prepare image for the model
        >>> inputs = feature_extractor(images=image, return_tensors="pt")

        >>> # forward pass
        >>> outputs = model(**inputs)

        >>> # the last hidden states are the final query embeddings of the Transformer decoder
        >>> # these are of shape (batch_size, num_queries, hidden_size)
        >>> last_hidden_states = outputs.last_hidden_state
        >>> list(last_hidden_states.shape)
        [1, 100, 256]
        ```"""
        output_attentions = output_attentions if output_attentions is not None else self.config.output_attentions
        output_hidden_states = (
            output_hidden_states if output_hidden_states is not None else self.config.output_hidden_states
        )
        return_dict = return_dict if return_dict is not None else self.config.use_return_dict

        batch_size, num_channels, height, width = pixel_values.shape
        device = pixel_values.device

        if pixel_mask is None:
            pixel_mask = torch.ones(((batch_size, height, width)), device=device)

        # First, sent pixel_values + pixel_mask through Backbone to obtain the features
        # pixel_values should be of shape (batch_size, num_channels, height, width)
        # pixel_mask should be of shape (batch_size, height, width)
        features, position_embeddings_list = self.model.backbone(pixel_values, pixel_mask)

        # get final feature map and downsampled mask
        feature_map, mask = features[-1]

        if mask is None:
            raise ValueError("Backbone does not return downsampled pixel mask")

        # Second, apply 1x1 convolution to reduce the channel dimension to d_model (256 by default)
        projected_feature_map = self.model.input_projection(feature_map)

        # Third, flatten the feature map + position embeddings of shape NxCxHxW to NxCxHW, and permute it to NxHWxC
        # In other words, turn their shape into (batch_size, sequence_length, hidden_size)
        flattened_features = projected_feature_map.flatten(2).permute(0, 2, 1)
        
        # encoding extension must be considered here
        if position_embeddings_list[-1].ndim == 3:
            # here, flatten() has already been performed
            position_embeddings = position_embeddings_list[-1].permute(0, 2, 1)
        elif position_embeddings_list[-1].ndim == 4:
            # default setting
            position_embeddings = position_embeddings_list[-1].flatten(2).permute(0, 2, 1)

        flattened_mask = mask.flatten(1)

        # append extra queries before the encoder
        if self.additional_queries == 'before_encoder':
            flattened_features = torch.cat((flattened_features, simulation_embeddings), dim=1)
            flattened_mask = torch.cat((flattened_mask, torch.ones(simulation_embeddings.size(0), simulation_embeddings.size(1), dtype=torch.bool, device=flattened_mask.device)), dim=1)

        # Fourth, sent flattened_features + flattened_mask + position embeddings through encoder
        # flattened_features is a Tensor of shape (batch_size, heigth*width, hidden_size)
        # flattened_mask is a Tensor of shape (batch_size, heigth*width)
        if encoder_outputs is None:
            encoder_outputs = self.model.encoder(
                inputs_embeds=flattened_features,
                attention_mask=flattened_mask,
                position_embeddings=position_embeddings,
                output_attentions=output_attentions,
                output_hidden_states=output_hidden_states,
                return_dict=return_dict,
            )
        # If the user passed a tuple for encoder_outputs, we wrap it in a BaseModelOutput when return_dict=True
        elif return_dict and not isinstance(encoder_outputs, BaseModelOutput):
            encoder_outputs = BaseModelOutput(
                last_hidden_state=encoder_outputs[0],
                hidden_states=encoder_outputs[1] if len(encoder_outputs) > 1 else None,
                attentions=encoder_outputs[2] if len(encoder_outputs) > 2 else None,
            )

        # Fifth, sent query embeddings + position embeddings through the decoder (which is conditioned on the encoder output)
        query_position_embeddings = self.model.query_position_embeddings.weight.unsqueeze(0).repeat(batch_size, 1, 1)

        # append extra queries after the encoder
        if self.additional_queries == 'after_encoder':
            queries = torch.zeros_like(query_position_embeddings)
            assert (encoder_outputs[0].requires_grad == simulation_embeddings.requires_grad)
            encoder_outputs['last_hidden_state'] = torch.cat((encoder_outputs[0], simulation_embeddings), dim=1)
            flattened_mask = torch.cat((flattened_mask, torch.ones(simulation_embeddings.size(0), simulation_embeddings.size(1), dtype=torch.bool, device=flattened_mask.device)), dim=1)
        else:
            queries = torch.zeros_like(query_position_embeddings)

        # decoder outputs consists of (dec_features, dec_hidden, dec_attn)
        decoder_outputs = self.model.decoder(
            inputs_embeds=queries,
            attention_mask=None,
            position_embeddings=position_embeddings,
            query_position_embeddings=query_position_embeddings,
            encoder_hidden_states=encoder_outputs[0],
            encoder_attention_mask=flattened_mask,
            output_attentions=output_attentions,
            output_hidden_states=output_hidden_states,
            return_dict=return_dict,
        )

        if not return_dict:
            return decoder_outputs + encoder_outputs

        return DetrModelOutput(
            last_hidden_state=decoder_outputs.last_hidden_state,
            decoder_hidden_states=decoder_outputs.hidden_states,
            decoder_attentions=decoder_outputs.attentions,
            cross_attentions=decoder_outputs.cross_attentions,
            encoder_last_hidden_state=encoder_outputs.last_hidden_state,
            encoder_hidden_states=encoder_outputs.hidden_states,
            encoder_attentions=encoder_outputs.attentions,
            intermediate_hidden_states=decoder_outputs.intermediate_hidden_states,
        )

    
    
    #################################################################################
    # DETR_OD FORWARD ###############################################################
    #################################################################################
    @add_start_docstrings_to_model_forward(DETR_INPUTS_DOCSTRING)
    @replace_return_docstrings(output_type=DetrObjectDetectionOutput, config_class=_CONFIG_FOR_DOC)
    def forward(
        self,
        pixel_values,
        information_ids, # added to original code
        pixel_mask=None,
        decoder_attention_mask=None,
        encoder_outputs=None,
        inputs_embeds=None,
        decoder_inputs_embeds=None,
        labels=None,
        output_attentions=None,
        output_hidden_states=None,
        return_dict=None,
    ):
        r"""
        labels (`List[Dict]` of len `(batch_size,)`, *optional*):
            Labels for computing the bipartite matching loss. List of dicts, each dictionary containing at least the
            following 2 keys: 'class_labels' and 'boxes' (the class labels and bounding boxes of an image in the batch
            respectively). The class labels themselves should be a `torch.LongTensor` of len `(number of bounding boxes
            in the image,)` and the boxes a `torch.FloatTensor` of shape `(number of bounding boxes in the image, 4)`.

        Returns:

        Examples:

        ```python
        >>> from transformers import DetrFeatureExtractor, DetrForObjectDetection
        >>> import torch
        >>> from PIL import Image
        >>> import requests

        >>> url = "http://images.cocodataset.org/val2017/000000039769.jpg"
        >>> image = Image.open(requests.get(url, stream=True).raw)

        >>> feature_extractor = DetrFeatureExtractor.from_pretrained("facebook/detr-resnet-50")
        >>> model = DetrForObjectDetection.from_pretrained("facebook/detr-resnet-50")

        >>> inputs = feature_extractor(images=image, return_tensors="pt")
        >>> outputs = model(**inputs)

        >>> # convert outputs (bounding boxes and class logits) to COCO API
        >>> target_sizes = torch.tensor([image.size[::-1]])
        >>> results = feature_extractor.post_process(outputs, target_sizes=target_sizes)[0]

        >>> for score, label, box in zip(results["scores"], results["labels"], results["boxes"]):
        ...     box = [round(i, 2) for i in box.tolist()]
        ...     # let's only keep detections with score > 0.9
        ...     if score > 0.9:
        ...         print(
        ...             f"Detected {model.config.id2label[label.item()]} with confidence "
        ...             f"{round(score.item(), 3)} at location {box}."
        ...         )
        ```"""
        return_dict = return_dict if return_dict is not None else self.config.use_return_dict

        if self.additional_queries in ['vanilla_imgAugm', 'vanilla']:
            # vanilla and imgAugm
            simulation_embeddings = None
        else:
            agent_ids, central_ids, sides_ids, obstacle_ids = torch.split(information_ids, 1, dim=1)
            # before_encoder and after_encoder
            if self.central_ascent_embeddings is None and self.sides_ascent_embeddings is None:
                simulation_embeddings = self.agent_embeddings(agent_ids).repeat(1, self.num_extra_queries, 1)
            # before_encoder+ and after_encoder+
            elif self.central_ascent_embeddings is not None and self.sides_ascent_embeddings is not None:
                agent_embeddings = self.agent_embeddings(agent_ids).repeat(1, self.num_extra_queries//4, 1)
                central_ascent_embeddings = self.central_ascent_embeddings(central_ids).repeat(1, self.num_extra_queries//4, 1)
                sides_ascent_embeddings = self.sides_ascent_embeddings(sides_ids).repeat(1, self.num_extra_queries//4, 1)
                obstacle_presence_embeddings = self.obstacle_presence_embeddings(obstacle_ids).repeat(1, self.num_extra_queries//4, 1)
                simulation_embeddings = torch.cat((agent_embeddings, central_ascent_embeddings, sides_ascent_embeddings, obstacle_presence_embeddings), dim=1)
            assert simulation_embeddings.shape == (information_ids.size(0), self.num_extra_queries, self.embed_dim), f'Wrong dimensions given, got ({simulation_embeddings.shape}() but should be ({information_ids.size(0), self.num_extra_queries, self.embed_dim})'

        # First, sent images through DETR base model to obtain encoder + decoder outputs
        outputs = self.model(
            pixel_values,
            simulation_embeddings,
            pixel_mask=pixel_mask,
            decoder_attention_mask=decoder_attention_mask,
            encoder_outputs=encoder_outputs,
            inputs_embeds=inputs_embeds,
            decoder_inputs_embeds=decoder_inputs_embeds,
            output_attentions=output_attentions,
            output_hidden_states=output_hidden_states,
            return_dict=return_dict,
        )

        sequence_output = outputs[0]

        # class logits + predicted bounding boxes
        logits = self.class_labels_classifier(sequence_output)
        pred_boxes = self.bbox_predictor(sequence_output).sigmoid()

        loss, loss_dict, auxiliary_outputs = None, None, None
        if labels is not None:
            raise ValueError("labels can only be None in inference mode!")

        if not return_dict:
            if auxiliary_outputs is not None:
                output = (logits, pred_boxes) + auxiliary_outputs + outputs
            else:
                output = (logits, pred_boxes) + outputs
            return ((loss, loss_dict) + output) if loss is not None else output

        return DetrObjectDetectionOutput(
            loss=loss,
            loss_dict=loss_dict,
            logits=logits,
            pred_boxes=pred_boxes,
            auxiliary_outputs=auxiliary_outputs,
            last_hidden_state=outputs.last_hidden_state,
            decoder_hidden_states=outputs.decoder_hidden_states,
            decoder_attentions=outputs.decoder_attentions,
            cross_attentions=outputs.cross_attentions,
            encoder_last_hidden_state=outputs.encoder_last_hidden_state,
            encoder_hidden_states=outputs.encoder_hidden_states,
            encoder_attentions=outputs.encoder_attentions,
        )


class DetrSinePositionEmbedding_custom(torch.nn.Module):
    """
    This is a more standard version of the position embedding, very similar to the one used by the Attention is all you
    need paper, generalized to work on images.
    """

    def __init__(self, embedding_dim=64, temperature=10000, normalize=False, scale=None, num_extra_queries=0):
        super().__init__()
        self.embedding_dim = embedding_dim
        self.temperature = temperature
        self.normalize = normalize
        if scale is not None and normalize is False:
            raise ValueError("normalize should be True if scale is passed")
        if scale is None:
            scale = 2 * math.pi
        self.scale = scale
        self.num_extra_queries = num_extra_queries
        assert self.num_extra_queries % 2 == 0, 'self.num_extra_queries must be divisible by 2 (sin-cos positional encodings)'

    def forward(self, pixel_values, pixel_mask):
        if pixel_mask is None:
            raise ValueError("No pixel mask provided")
        y_embed = pixel_mask.cumsum(1, dtype=torch.float32)
        x_embed = pixel_mask.cumsum(2, dtype=torch.float32)

        normalizer_pix_x = x_embed[:, :, -1:][0,0,0]
        normalizer_pix_y = y_embed[:, -1:, :][0,0,0]
        normalizer_pix = max(normalizer_pix_x, normalizer_pix_y)

        normalizer = normalizer_pix + self.num_extra_queries

        extend = torch.arange(normalizer_pix+1, normalizer+1, dtype=torch.float32, device=pixel_values.device)
        extend = torch.tile(extend, (pixel_values.shape[0], 1))

        if self.normalize:
            y_embed = y_embed / (y_embed[:, -1:, :] + 1e-6) * self.scale
            x_embed = x_embed / (x_embed[:, :, -1:] + 1e-6) * self.scale

            extend = extend / normalizer_pix * self.scale # or normalizer

        dim_t = torch.arange(self.embedding_dim, dtype=torch.float32, device=pixel_values.device)
        dim_t = self.temperature ** (2 * torch.div(dim_t, 2, rounding_mode="floor") / self.embedding_dim)

        pos_x = x_embed[:, :, :, None] / dim_t
        pos_y = y_embed[:, :, :, None] / dim_t
        extend = extend[:, :, None] / dim_t
        pos_x = torch.stack((pos_x[:, :, :, 0::2].sin(), pos_x[:, :, :, 1::2].cos()), dim=4).flatten(3)
        pos_y = torch.stack((pos_y[:, :, :, 0::2].sin(), pos_y[:, :, :, 1::2].cos()), dim=4).flatten(3)
        extend = torch.stack((extend[:, :, 0::2].sin(), extend[:, :, 1::2].cos()), dim=3).flatten(2)
        extend = torch.cat((extend, extend), dim=2).permute(0, 2, 1)
        pos = torch.cat((pos_y, pos_x), dim=3).permute(0, 3, 1, 2)
        pos = pos.flatten(2)
        pos = torch.cat((pos, extend), dim=2)
        return pos


def xywhn2xyxy(x, w=640, h=640, padw=0, padh=0):
    # Convert nx4 boxes from [x, y, w, h] normalized to [x1, y1, x2, y2] where xy1=top-left, xy2=bottom-right
    y = x.clone() if isinstance(x, torch.Tensor) else np.copy(x)
    y[..., 0] = w * (x[..., 0] - x[..., 2] / 2) + padw  # top left x
    y[..., 1] = h * (x[..., 1] - x[..., 3] / 2) + padh  # top left y
    y[..., 2] = w * (x[..., 0] + x[..., 2] / 2) + padw  # bottom right x
    y[..., 3] = h * (x[..., 1] + x[..., 3] / 2) + padh  # bottom right y
    return y


# mock inputs
input_image = torch.randn((1, 3, 1536, 640))
num_agents = 10

model = Detr_custom()
agentIdDict = {10:0, 30:1, 50: 2}
all_pred_boxes, all_confidences = [], []

# object detection module
# module = load_ckpt(module, ckpt_path = CONFIG['from_ckpt_path'])

# module.to(f'cuda:{CUDA_DEVICE}')
# module.eval()

agentId = agentIdDict[num_agents] # optionally '+'-info
central_id, sides_id, obstacle_id = 0,0,0 # dummies for now
suppl_info = torch.LongTensor([agentId, central_id, sides_id, obstacle_id]).unsqueeze(0)
prediction = model(input_image, suppl_info, labels=None)

# Find predicted boxes
for i in range(prediction.logits.size(0)):
    scores = torch.softmax(prediction.logits[i].detach(), dim=-1)
    argmaxes = torch.argmax(scores, dim=-1)
    box_detection_indices = torch.argwhere(argmaxes == 0).squeeze() # select only boxes with class 0 (class 1 == 'no-object')
    selected_scores = scores[box_detection_indices, 0]
    # assert torch.all(selected_scores > scores[box_detection_indices, 1])
    box_proposals_per_batch = prediction.pred_boxes[i].detach()
    selected_boxes = box_proposals_per_batch[box_detection_indices]

    # for score predictions consisting of a single number, get the dimensions right
    if selected_scores.ndim==0:
        selected_boxes, selected_scores = selected_boxes.unsqueeze(0), selected_scores.unsqueeze(0)
    
    all_pred_boxes.append(xywhn2xyxy(selected_boxes, input_image.size(3), input_image.size(2)).detach().cpu())
    all_confidences.append(selected_scores.cpu())
    
OUT = [all_pred_boxes, all_confidences]



#package_path = f"{virt_env_path}\\lib\\site-packages\\"
#sys.path.append(package_path)

#import pytorch_lightning
#import torchmetrics
# TODO additional info....



"""
# checkpoint loading
def load_ckpt(module: LightningModule, ckpt_path):
    CKPT_PATH = SEP.join(['checkpoints', ckpt_path])
    model_file_path = [file for file in os.listdir(CKPT_PATH) if file.endswith('.ckpt') and not file.startswith('last')]
    assert len(model_file_path) == 1
    CKPT_PATH = SEP.join([CKPT_PATH, model_file_path[0]])
    state_dict = torch.load(CKPT_PATH)['state_dict']
    module_state_dict = module.state_dict()

    mkeys_missing_in_loaded = [module_key for module_key in list(module_state_dict.keys()) if module_key not in list(state_dict.keys())]
    lkeys_missing_in_module = [loaded_key for loaded_key in list(state_dict.keys()) if loaded_key not in list(module_state_dict.keys())]
    assert len(mkeys_missing_in_loaded) < 10 or len(lkeys_missing_in_module) < 10, 'Checkpoint loading went probably wrong...'

    load_dict = OrderedDict()
    for key, tensor in module_state_dict.items():
        if key in state_dict.keys() and tensor.size()==state_dict[key].size():
            load_dict[key] = state_dict[key]
        else:
            load_dict[key] = tensor

    module.load_state_dict(load_dict)

    return module
"""
# ----------------------------------------

image_display_2 = Python(IN[0]=forward_pass)  # CPython3
# ---------- image_display_2.python (27 lines) ----------
import clr
import System
from System.IO import *
clr.AddReference('ProtoGeometry')
from Autodesk.DesignScript.Geometry import *

clr.AddReference("RevitServices")
import RevitServices
from RevitServices.Persistence import DocumentManager 

clr.AddReference("RevitAPI")
from Autodesk.Revit.DB import *

clr.AddReference('System.Drawing')
import System.Drawing
from System.Drawing import *

# The inputs to this node will be stored as a list in the IN variables.
dataEnteringNode = IN

# Place your code below this line
filePath = IN[0]

#result = Image.FromFile(filePath)

# Assign your output to the OUT variable.
OUT = None#result
# ----------------------------------------
critical_area_prediction = WatchImageCore()  # unwired: image
watch = Watch(forward_pass)
